# Grasshopper definition VisualAccessAssessment.gh (Grasshopper 1.0.7)
# plug-ins: LunchBox, Pufferfish, Karamba3D, ShapeDiverForGrasshopper, treesloth01, Human, Kangaroo2 Components, Shortest Walk in Gh, BitmapPlus

manual_unit_id_index = Slider(256, range=0..267)
panel = Panel("from 0 to 267")

# ----
# 1. Load the dataset to be used for the assessment.
# 2. Set the isovist properties.
# 3. Activate data recorder
# 4. Set the trigger to True
# READ ME
panel_2 = Panel(" ")

# ----
# Right-click,
# Change file path
select_file_path_by_right_clicking_on_th = FilePath("C:\Users\Home PC\Documents\P5\ProjectCode\Expanded_Experiment\Files\Geo\top_268_unique_ids.xlsx")  # "Select File Path by Right Clicking On This Component"

# ----
# 1. Load floor plan dataset
worksheet_name = Panel("Top 268 Unique IDs")
read_file = BooleanToggle(True)

excelread = ExcelReader(ReadExcelData=read_file, WorkbookPath=select_file_path_by_right_clicking_on_th, WorksheetName=worksheet_name)  # -> Exceptions, ExcelData
selected_file = Panel(select_file_path_by_right_clicking_on_th)
bang = ExplodeTree(Data=excelread.ExcelData)  # -> Branch0, Branch1, Branch2, Branch3, Branch4, Branch5, Branch6, Branch7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
panel_3 = Panel(bang.Branch9)
panel_4 = Panel(bang.Branch5)
panel_5 = Panel(bang.Branch7)
panel_6 = Panel(bang.Branch8)

# ----
# 2. Isovist Grid Settings
# Do not change.
# The settings here allow for greater variability between visual access.
min_distance_from_wall = Slider(0.75, range=0.25..2.5)
grid_spacing_meters = Slider(1, range=0.5..2.22)
isovist_length = Slider(12, range=0..20)
isovist_count = Slider(24, range=2..100)

# ----
# CONTROL CENTER
panel_7 = Panel("DO NOT CHANGE")

# ----
# P5
# 190624
internalize = Data([0.375, 0.125, "0", 1, 0.8333333333, 0.56, 0.68, 0.6470588235, 1, 1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])
internalize_2 = Data(["0", "0", "0", "0", "0", "0", 0.48, "0", "0", "0"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])
internalize_3 = Data(["53095", "134183", "134200", "130199", "130203", "130516", "130521", "130525", "134003", "134011"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])
internalize_4 = Data(["0", "0", 0.04761904762, "0", "0", 0.12, "0", 0.1911764706, "0", 0.875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])
internalize_5 = Data(["0", "0", "0", "0", "0", 0.12, "0", 0.07352941176, 1, 0.25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])
internalize_6 = Data(["0", "0", "0", "0", "0", "0", "0", "0", "0", "0"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])
internalize_7 = Data([2, 2, 2, 2, 2, 3, 3, 2, 2, 2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])
internalize_8 = Data(["Unit_id 53095: VALID GEOMETRY", "Unit_id 134183: VALID GEOMETRY", "Unit_id 134200: VALID GEOMETRY", "Unit_id 130199: VALID GEOMETRY", "Unit_id 130203: VALID GEOMETRY", "Unit_id 130516: VALID GEOMETRY"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])
internalize_9 = Data([2.25, "0", "0", 0.0625, "0", 1.44, "0", 1.426470588, "0", "0"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])
internalize_10 = Data(["0", "0", "0", 0.4375, "0", 0.08, "0", 0.08823529412, "0", "0"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])
internalize_11 = Data(["0", "0", "0", "0", "0", 0.12, 0.04, "0", "0", 0.125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])
internalize_12 = Data(["0", "0", "0", "0", "0", "0", "0", "0", "0", "0"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])
internalize_13 = Data(["0", "0", "0", "0", "0", "0", "0", "0", "0", "0"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])
internalize_14 = Data([3, 3, 3, 4, 4, 3, 4, 2, 3, 3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])
valid_invalid_geometry_data_recorder = Data(internalize_8)
unit_id_data_recorder = Data(internalize_3)
living_kitchen = Data(internalize)
toilet_1_data_recorder = Data(internalize_4)
toilet_2_data_recorder = Data(internalize_5)
toilet_3_data_recorder = Data(internalize_6)
of_bathrooms_data_recorder = Data(internalize_7)
bedroom_1_data_recorder = Data(internalize_9)
bedroom_2_data_recorder = Data(internalize_10)
bedroom_3_data_recorder = Data(internalize_11)
bedroom_4_data_recorder = Data(internalize_2)
bedroom_5_data_recorder = Data(internalize_12)
of_bedrooms_data_recorder = Data(internalize_14)
bedroom_6_data_recorder = Data(internalize_13)

panel_8 = Panel("TOGGLE 'TRUE' TO CAPTURE")

text_width = Slider(1.8, range=0..2)
text_depth = Slider(0.01, range=0.01..0.1)
text_height = Slider(0.4, range=0..1)

# ---- group: Variables
number_slider = Slider(0.15, range=0..1)  # disabled

# ----
show_wire = BooleanToggle(False)  # disabled
show_nb_rebond = BooleanToggle(False)  # disabled
nb_ms = Slider(93, range=1..250)  # disabled

nb_bounces = Slider(30, range=1..30)  # disabled
angle_ouverture = Slider(0, range=0..175)  # disabled
nb_ray = Slider(1, range=1..20)  # disabled

orientationz = Slider(0, range=0..360)  # disabled
orientationxy = Slider(34, range=0..360)  # disabled

# ---- group: End type (offset)
list = ValueList({"Round : Constant slope (sand)": 0, "Butt  : Angular (roof)": 1, "Square : Simple": 2}, selected="Butt  : Angular (roof)")  # disabled

# ---- group: Curve simplification
number_slider_2 = Slider(180, range=0..180)  # disabled
curve_simplification_unitless = Slider(0.084, range=0.01..0.25)  # disabled

# ---- group: select see % of path
number_slider_3 = Slider(100, range=0..100)  # disabled

# ----
min_distance_from_wall_2 = Data(min_distance_from_wall)
grid_spacing_meters_2 = Data(grid_spacing_meters)
isovist_length_2 = Data(isovist_length)
isovist_count_2 = Data(isovist_count)
panel_9 = Panel("""1
2
3
4
5
6
7
8
9
10""")
reverse_list = ReverseList(List=panel_9)
panel_10 = Panel("2_1")
panel_11 = Panel("G:\My Drive\06 Academics\TU Delft\Graduation Studio\Datasets\Performance Assessment Data\Files\Results\2_1.xlsx")
write_files = BooleanToggle(False)

# ----
# Data can also be directly written to excel using a flat list structure where the list of items in each index is a row.
# Write DataTree to Excel
_2_1 = Data(flatten(reverse_list))
excel_write = ExcelWrite(
    WriteExcelData=write_files,
    WorkbookPath=panel_11,
    WorksheetName="2_1",
    ColumnHeadings="2_1",
    Data=_2_1,
    ClearSheet=Toggle(True))  # disabled
panel_12 = Panel(excel_write)

series = Series(Start=0, Step=1, Count="284")
repeat_data = RepeatData(Data="LIVING", Length=series)  # -> flatten(Data)

# ----
# Below are the two possible trigger options: timer and manual.
# 
# Note: to unpause the timer, right-click canvas and "LOCK SOLVER" to avoid issues with disabling the trigger
# Warnings / Feedback
# Connect one of the two options
trigger = Trigger(Interval=-1000, TimerInterval=1000)  # disabled
trigger_2 = Trigger(Interval=1000, TimerInterval=1000)  # disabled
manual_unit_id_selector = Data(manual_unit_id_index)

# ----
# 4, Start Assessment
# True: initiate
# False: reset
trigger_3 = Trigger(Interval=50, TimerInterval=50, Target=[time, python_9, button])  # disabled

# ----
# SELECTING UNIT ID FOR TESTING
cset = CreateSet(List=bang.Branch5)  # -> Set, Map
cull_i = CullIndex(List=cset.Set, Indices="0", Wrap=True)

button = Button()

inflatebox = Slider(3, range=-100..100)
panel_13 = Panel("auto zoom-select")

time = Timekeeper(Play=Toggle(True), Pause="False", Max="269")  # -> out, C, H
# ---------- time: VB ----------
    component.Params.Output(0).Name = "HMS"
    component.Params.Output(0).Description = "Hours, Minutes and seconds"
    component.Params.Output(1).Name = "Count"
    component.Params.Output(1).Description = "Counter"
    component.Params.Output(2).Name = "Hours"
    component.Params.Output(2).Description = "Hours in decimal value"

    Timer = FindGhTimer()

    If play And Not pause Then
      count += 1
      pararTimer = False
    Else
      If Not pause Then count = 0
      pararTimer = True
    End If

    C = count

    If Max <> 0 AndAlso Count >= Max Then pararTimer = True
    If timer IsNot Nothing Then
      Timer.Locked = PararTimer
      Dim span As TimeSpan = TimeSpan.FromSeconds(Count * (timer.Interval / 1000))
      Print(String.Format("{0}h {1}m {2}s", span.Hours, span.Minutes, span.Seconds))
      H = span.Minutes / 60 + span.Hours
    End If
# ---------- time: VB additional code ----------
  Dim count As New Integer
  Dim Timer As Grasshopper.Kernel.Special.GH_Timer
  Dim pararTimer As New Boolean

  Function FindGhTimer() As Grasshopper.Kernel.Special.GH_Timer
    Dim ghDoc As GH_Document = owner.OnPingDocument()
    If ghDoc Is Nothing Then Return Nothing
    For Each obj As IGH_DocumentObject In ghDoc.Objects
      If TypeOf(obj) Is Grasshopper.Kernel.Special.GH_Timer Then
        Dim timer As Grasshopper.Kernel.Special.GH_Timer = DirectCast(obj, grasshopper.Kernel.Special.GH_Timer)
        If timer.Targets.Contains(owner.InstanceGuid) Then Return timer
      End If
    Next
    Return Nothing
  End Function
# ---------- end time ----------
subtraction = Subtraction(A="269", B=time.C)

unit_id_index = Panel(subtraction)

data = Data(subtraction)

automatic_descenending_layouts = Data(subtraction)
activate = Data(automatic_descenending_layouts)
unit_id_index_2 = Panel(activate)

unit_id_index_3 = Data(unit_id_index_2)

item = ListItem(List=cull_i, Index=unit_id_index_3, Wrap=False)
unit_id = Panel(item)

# ----
# 1 UNIT ID SELECTED TO ISOLATE GEOMETRY
expression = Expression(x=bang.Branch5, y=unit_id, Expression="x = Y")
dispatch = Dispatch(List=excelread.ExcelData, DispatchPattern=expression)  # -> simplify(ListA), ListB
unit_id_selection = Data(dispatch.ListA)

bang_2 = ExplodeTree(Data=simplify(unit_id_selection))  # -> Branch0, Branch1, Branch2, Branch3, Branch4, Branch5, Branch6, Branch7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

unit_id_2 = Panel(unit_id)

# ----
# 3. data recorders
# CLEAR everything before beginning to record.
# 
# Once the recording is done, immediately internalize to save a copy.
unitid = DataRecorder(unit_id_2, DataLimit=-10, RecordData=True)
livedata_do_not_internalize = Data(unitid)

selected_layout_unit_id = Data(bang_2.Branch5)
item_2 = ListItem(List=selected_layout_unit_id, Index="0", Wrap=False)

unitid_item = Data(item_2)

# ----
# Capturing rhino viewport as screenshots
# and recording the file name using unit_id
panel_14 = Panel("268")
subtraction_2 = Subtraction(A=unit_id_index_3, B=panel_14)
absolute = Absolute(Value=subtraction_2)
panel_15 = Panel(absolute)
ghpython_script = GhPythonScript(x=panel_15, y="_", z=unitid_item)  # -> output, a
# ---------- ghpython_script: Python ----------
__author__ = "Home PC"
__version__ = "2024.04.25"

import rhinoscriptsyntax as rs

# Define the function to concatenate inputs
def concatenate(x, y, z):
    return x + y + z



# Call the function with inputs
output = concatenate(x, y, z)

# Print the output
print(output)
# ---------- end ghpython_script ----------

viewport = Panel("Top")
viewport_2 = Panel("Wireframe")
folderpath = Panel("G:\My Drive\06 Academics\TU Delft\Graduation Studio\Datasets\Animations\500Sample_Assessment")
captureview = LBCaptureView(
    file_name=ghpython_script.output,
    folder=folderpath,
    viewport=viewport,
    mode=viewport_2,
    transparent=Toggle(True),
    capture=Toggle(False))  # -> Output; plug-in component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

# ----
# DINING
_10_geometry_selected_unit_id = Data(bang_2.Branch10)
_9_entity_subtype = Data(bang_2.Branch9)
data_2 = Data(_9_entity_subtype)
expression_2 = Expression(x=data_2, y="DINING", Expression="x = Y")
dispatch_2 = Dispatch(List=_10_geometry_selected_unit_id, DispatchPattern=expression_2)  # -> ListA, ListB
python = GhPythonScript(wkt_polygon=dispatch_2.ListA)  # -> out, pt_list
# ---------- python: Python ----------
"""Provides a scripting component.
    Inputs:
        wkt_polygon: Text from dataset with polygon info
    Output:
        x : 
        pt_list: List of points in polygon"""

__author__ = "Lotte 2023"
__version__ = "2023.07.14"

import rhinoscriptsyntax as rs
import re

text = wkt_polygon

# Extracting the coordinate values using regular expression
matches = re.findall(r'[-\d.]+', text)

# Creating pairs of coordinates
coordinates = [(matches[i], matches[i+1]) for i in range(0, len(matches), 2)]

# Removing brackets and quotes from coordinates
coordinates = [", ".join(coord) for coord in coordinates]

pt_list = coordinates
# ---------- end python ----------
pt = Point(python.pt_list)
pline = PolyLine(Vertices=pt, Closed=False)
_0_5_to_0_5 = Slider(-0.2, range=-0.5..0.5)
boundary = BoundarySurfaces(Edges=pline)
arrangelayer = ArrangeLayer(G=boundary, F=_0_5_to_0_5)
preview = CustomPreview(Geometry=arrangelayer, Material=ColourSwatch(SwatchColor=RGB(250, 172, 104)))

# ----
# BATH
_10_geometry_selected_unit_id_2 = Data(bang_2.Branch10)
_9_entity_subtype_2 = Data(bang_2.Branch9)
data_3 = Data(_9_entity_subtype_2)
expression_3 = Expression(x=data_3, y="BATH", Expression="x = Y")
dispatch_3 = Dispatch(List=_10_geometry_selected_unit_id_2, DispatchPattern=expression_3)  # -> ListA, ListB
python_2 = GhPythonScript(wkt_polygon=dispatch_3.ListA)  # -> out, pt_list; same code as python
pt_2 = Point(python_2.pt_list)
pline_2 = PolyLine(Vertices=pt_2, Closed=False)
_0_5_to_0_5_2 = Slider(-0.2, range=-0.5..0.5)
boundary_2 = BoundarySurfaces(Edges=pline_2)
arrangelayer_2 = ArrangeLayer(G=boundary_2, F=_0_5_to_0_5_2)
preview_2 = CustomPreview(Geometry=arrangelayer_2, Material=ColourSwatch(SwatchColor=RGB(107, 109, 178)))

# ----
# BEDROOM
_10_geometry_selected_unit_id_3 = Data(bang_2.Branch10)
_9_entity_subtype_3 = Data(bang_2.Branch9)
data_4 = Data(_9_entity_subtype_3)
expression_4 = Expression(x=data_4, y="BEDROOM", Expression="x = Y")
dispatch_4 = Dispatch(List=_10_geometry_selected_unit_id_3, DispatchPattern=expression_4)  # -> ListA, ListB
python_3 = GhPythonScript(wkt_polygon=dispatch_4.ListA)  # -> out, pt_list; same code as python
pt_3 = Point(python_3.pt_list)
pline_3 = PolyLine(Vertices=pt_3, Closed=False)
_0_5_to_0_5_3 = Slider(-0.2, range=-0.5..0.5)
boundary_3 = BoundarySurfaces(Edges=pline_3)
arrangelayer_3 = ArrangeLayer(G=boundary_3, F=_0_5_to_0_5_3)
preview_3 = CustomPreview(Geometry=arrangelayer_3, Material=ColourSwatch(SwatchColor=RGB(34, 120, 177)))

# ----
# LIVING
_10_geometry_selected_unit_id_4 = Data(bang_2.Branch10)
_9_entity_subtype_4 = Data(bang_2.Branch9)
data_5 = Data(_9_entity_subtype_4)
expression_5 = Expression(x=data_5, y="LIVING", Expression="x = Y")
dispatch_5 = Dispatch(List=_10_geometry_selected_unit_id_4, DispatchPattern=expression_5)  # -> ListA, ListB
python_4 = GhPythonScript(wkt_polygon=dispatch_5.ListA)  # -> out, pt_list; same code as python
pt_4 = Point(python_4.pt_list)
pline_4 = PolyLine(Vertices=pt_4, Closed=False)
_0_5_to_0_5_4 = Slider(-0.2, range=-0.5..0.5)
boundary_4 = BoundarySurfaces(Edges=pline_4)
arrangelayer_4 = ArrangeLayer(G=boundary_4, F=_0_5_to_0_5_4)
preview_4 = CustomPreview(Geometry=arrangelayer_4, Material=ColourSwatch(SwatchColor=RGB(227, 87, 37)))

# ----
# CORRIDOR
_10_geometry_selected_unit_id_5 = Data(bang_2.Branch10)
_9_entity_subtype_5 = Data(bang_2.Branch9)
data_6 = Data(_9_entity_subtype_5)
expression_6 = Expression(x=data_6, y="CORRIDOR", Expression="x = Y")
dispatch_6 = Dispatch(List=_10_geometry_selected_unit_id_5, DispatchPattern=expression_6)  # -> ListA, ListB
python_5 = GhPythonScript(wkt_polygon=dispatch_6.ListA)  # -> out, pt_list; same code as python
pt_5 = Point(python_5.pt_list)
pline_5 = PolyLine(Vertices=pt_5, Closed=False)
boundary_5 = BoundarySurfaces(Edges=pline_5)
_0_5_to_0_5_5 = Slider(-0.2, range=-0.5..0.5)
arrangelayer_5 = ArrangeLayer(G=boundary_5, F=_0_5_to_0_5_5)
preview_5 = CustomPreview(Geometry=arrangelayer_5, Material=ColourSwatch(SwatchColor=RGB(252, 208, 161)))

# ----
# KITCHEN
_10_geometry_selected_unit_id_6 = Data(bang_2.Branch10)
_9_entity_subtype_6 = Data(bang_2.Branch9)
data_7 = Data(_9_entity_subtype_6)
expression_7 = Expression(x=data_7, y="KITCHEN", Expression="x = Y")
dispatch_7 = Dispatch(List=_10_geometry_selected_unit_id_6, DispatchPattern=expression_7)  # -> ListA, ListB
python_6 = GhPythonScript(wkt_polygon=dispatch_7.ListA)  # -> out, pt_list; same code as python
pt_6 = Point(python_6.pt_list)
pline_6 = PolyLine(Vertices=pt_6, Closed=False)
_0_5_to_0_5_6 = Slider(-0.2, range=-0.5..0.5)
boundary_6 = BoundarySurfaces(Edges=pline_6)
item_3 = ListItem(List=flatten(boundary_6), Index=0, Wrap=True)
arrangelayer_6 = ArrangeLayer(G=item_3, F=_0_5_to_0_5_6)
preview_6 = CustomPreview(Geometry=arrangelayer_6, Material=ColourSwatch(SwatchColor=RGB(246, 141, 65)))

# ----
# OUTDOOR
_10_geometry_selected_unit_id_7 = Data(bang_2.Branch10)
_9_entity_subtype_7 = Data(bang_2.Branch9)
data_8 = Data(_9_entity_subtype_7)
expression_8 = Expression(x=data_8, y="OUTDOOR", Expression="x = Y")
dispatch_8 = Dispatch(List=_10_geometry_selected_unit_id_7, DispatchPattern=expression_8)  # -> ListA, ListB
python_7 = GhPythonScript(wkt_polygon=dispatch_8.ListA)  # -> out, pt_list; same code as python
pt_7 = Point(python_7.pt_list)
pline_7 = PolyLine(Vertices=pt_7, Closed=False)
_0_5_to_0_5_7 = Slider(-0.2, range=-0.5..0.5)
boundary_7 = BoundarySurfaces(Edges=pline_7)
arrangelayer_7 = ArrangeLayer(G=boundary_7, F=_0_5_to_0_5_7)
preview_7 = CustomPreview(Geometry=arrangelayer_7, Material=ColourSwatch(SwatchColor=RGB(47, 157, 0)))

# ----
# STORE / OTHERS
_10_geometry_selected_unit_id_8 = Data(bang_2.Branch10)
_9_entity_subtype_8 = Data(bang_2.Branch9)
data_9 = Data(_9_entity_subtype_8)
expression_9 = Expression(x=data_9, y="OTHER", Expression="x = Y")
dispatch_9 = Dispatch(List=_10_geometry_selected_unit_id_8, DispatchPattern=expression_9)  # -> ListA, ListB
python_8 = GhPythonScript(wkt_polygon=dispatch_9.ListA)  # -> out, pt_list; same code as python
pt_8 = Point(python_8.pt_list)
pline_8 = PolyLine(Vertices=pt_8, Closed=False)
_0_5_to_0_5_8 = Slider(-0.2, range=-0.5..0.5)
boundary_8 = BoundarySurfaces(Edges=pline_8)
arrangelayer_8 = ArrangeLayer(G=boundary_8, F=_0_5_to_0_5_8)
preview_8 = CustomPreview(Geometry=arrangelayer_8, Material=ColourSwatch(SwatchColor=RGB(102, 102, 102)))

zones = Geometry([arrangelayer_5, arrangelayer_3, arrangelayer_4, arrangelayer_6, arrangelayer, arrangelayer_2, arrangelayer_7, arrangelayer_8])
python_9 = GhPythonScript(Toggle="True", InflateBox=inflatebox, Geometry=flatten(zones))  # -> Result; inputs Geometry: list of GeometryBase
#   port Toggle: {item,system.object}
# ---------- python_9: Python ----------
import Rhino as rc

def zoomSelected(geometryBases, inflateFactor):
    """ Zoom to geometryBases ala Grasshopper Zoom function, inflate to zoom out """
    doc = rc.RhinoDoc.ActiveDoc
    bb = rc.Geometry.BoundingBox.Empty
    for gb in geometryBases:
        if gb is not None:  # Add a check to skip None geometry
            gb_bb = gb.GetBoundingBox(False)
            if gb_bb.IsValid:
                bb.Union(gb_bb)
    bb.Inflate(inflateFactor)
    for view in doc.Views:
        avp = view.ActiveViewport
        result = avp.ZoomBoundingBox(bb)

if Toggle and Geometry:
    zoomSelected(Geometry, InflateBox)
# ---------- end python_9 ----------
panel_16 = Panel(python_9)

# ----
# DOORS
_10_geometry_selected_unit_id_9 = Data(bang_2.Branch10)
_9_entity_subtype_9 = Data(bang_2.Branch9)
data_10 = Data(_9_entity_subtype_9)
expression_10 = Expression(x=data_10, y="DOOR", Expression="x = Y")
dispatch_10 = Dispatch(List=_10_geometry_selected_unit_id_9, DispatchPattern=expression_10)  # -> ListA, ListB
python_10 = GhPythonScript(wkt_polygon=dispatch_10.ListA)  # -> out, pt_list; same code as python
pt_9 = Point(python_10.pt_list)
pline_9 = PolyLine(Vertices=pt_9, Closed=False)
boundary_9 = BoundarySurfaces(Edges=pline_9)
join_curves = JoinCurves(Curves=pline_9, Preserve=False)  # -> flatten(Curves)
_0_5_to_0_5_9 = Slider(-0.3, range=-0.5..0.5)
arrangelayer_9 = ArrangeLayer(G=boundary_9, F=_0_5_to_0_5_9)
preview_9 = CustomPreview(Geometry=arrangelayer_9, Material=ColourSwatch(SwatchColor=RGBA(208, 0, 255, 175)))

# ----
# WALLS
_10_geometry_selected_unit_id_10 = Data(bang_2.Branch10)
# ISOLATING GEOMETRY BY TYPE
# Note:
# we have now selected one unit for evaluation, what we need to do next is separate geometries based on their classes: separator (walls), areas, openings, etc.
_9_entity_subtype_10 = Data(bang_2.Branch9)
data_11 = Data(_9_entity_subtype_10)
expression_11 = Expression(x=data_11, y="WALL", Expression="x = Y")
dispatch_11 = Dispatch(List=_10_geometry_selected_unit_id_10, DispatchPattern=expression_11)  # -> ListA, ListB
python_11 = GhPythonScript(wkt_polygon=dispatch_11.ListA)  # -> out, pt_list; same code as python
pt_10 = Point(python_11.pt_list)
pline_10 = PolyLine(Vertices=pt_10, Closed=False)
join_curves_2 = JoinCurves(Curves=pline_10, Preserve=False)  # -> flatten(Curves)
plane = Plane(join_curves)
region_difference = RegionDifference(CurvesA=join_curves_2, CurvesB=join_curves, Plane=plane)
boundary_10 = BoundarySurfaces(Edges=region_difference)
_0_5_to_0_5_10 = Slider(-0.4, range=-0.5..0.5)
arrangelayer_10 = ArrangeLayer(G=boundary_10, F=_0_5_to_0_5_10)
preview_10 = CustomPreview(Geometry=arrangelayer_10, Material=ColourSwatch(SwatchColor=RGB(0, 0, 0)))

# ----
# AREAS
# Isolating geometry per entity_subtype
_10_geometry_selected_unit_id_11 = Data(bang_2.Branch10)
_8_entity_type = Data(bang_2.Branch8)
data_12 = Data(_8_entity_type)
expression_12 = Expression(x=data_12, y="area", Expression="x = Y")
dispatch_12 = Dispatch(List=_10_geometry_selected_unit_id_11, DispatchPattern=expression_12)  # -> ListA, ListB
python_12 = GhPythonScript(wkt_polygon=dispatch_12.ListA)  # -> out, pt_list; same code as python
pt_11 = Point(python_12.pt_list)
pline_11 = PolyLine(Vertices=pt_11, Closed=False)
boundary_11 = BoundarySurfaces(Edges=pline_11)
_0_5_to_0_5_11 = Slider(-0.2, range=-0.5..0.5)
arrangelayer_11 = ArrangeLayer(G=boundary_11, F=_0_5_to_0_5_11)
preview_11 = CustomPreview(Geometry=arrangelayer_11, Material=ColourSwatch(SwatchColor=RGB(194, 194, 194)))

# ----
# WINDOWS
_10_geometry_selected_unit_id_12 = Data(bang_2.Branch10)
_9_entity_subtype_11 = Data(bang_2.Branch9)
data_13 = Data(_9_entity_subtype_11)
expression_13 = Expression(x=data_13, y="WINDOW", Expression="x = Y")
dispatch_13 = Dispatch(List=_10_geometry_selected_unit_id_12, DispatchPattern=expression_13)  # -> ListA, ListB
python_13 = GhPythonScript(wkt_polygon=dispatch_13.ListA)  # -> out, pt_list; same code as python
pt_12 = Point(python_13.pt_list)
pline_12 = PolyLine(Vertices=pt_12, Closed=False)
boundary_12 = BoundarySurfaces(Edges=pline_12)
_0_5_to_0_5_12 = Slider(-0.2, range=-0.5..0.5)
arrangelayer_12 = ArrangeLayer(G=boundary_12, F=_0_5_to_0_5_12)
preview_12 = CustomPreview(Geometry=arrangelayer_12, Material=ColourSwatch(SwatchColor=RGB(25, 255, 244)))

# ----
# ZONES GEOMETRY
bedrooms_boundary = Curve(pline_3)
corridor_boundary = Curve(pline_5)
outdoor_boundary = Curve(pline_7)
kitchen_boundary = Curve(pline_6)
dining_boundary = Curve(pline)
living_boundary = Curve(pline_4)
other_boundary = Curve(pline_8)
bath_boundary = Curve(pline_2)

# ----
# WALLS/DOORS GEOMETRY
walls_boundaries = Curve(region_difference)
doors_boundaries = Curve(pline_9)

area = Area(Geometry=kitchen_boundary)  # -> Area, Centroid

# ----
# Adding entity_subtype labels on the floor layout
allzones = Curve([corridor_boundary, bedrooms_boundary, living_boundary, kitchen_boundary, dining_boundary, outdoor_boundary, other_boundary, bath_boundary])
bounding_rectangle = BoundingRectangle(Geometry=flatten(allzones), Plane=PlaneXY(0, 0, 0), Axis=0, Slide=0, Union=True)  # -> Bounding, DimensionX, DimensionY

area_2 = Area(Geometry=boundary_8)  # -> Area, Centroid
surface_centroid = Data(area_2.Centroid)
zonename = Text("OTHER")
X = UnitX(Factor=text_width)
random_surface_with_correct_normal = Surface(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)
move = Move(Geometry=surface_centroid, Motion=X)  # -> Geometry, Transform
ln = Line(StartPoint=surface_centroid, EndPoint=move.Geometry)
flip = Flip(Surface=random_surface_with_correct_normal)  # -> Surface, Result
expression_14 = Expression(x=text_width, Expression="x / -2")
textsrf = TextOnSurface(
    Text=zonename,
    Font="Sans Bold:no Italic:no",
    Height=text_height,
    Depth=text_depth,
    BaseLine=ln,
    BaseSurface=flip.Surface)
X_2 = UnitX(Factor=expression_14)
move_2 = Move(Geometry=textsrf, Motion=X_2)  # -> Geometry, Transform

area_3 = Area(Geometry=boundary_7)  # -> Area, Centroid
surface_centroid_2 = Data(area_3.Centroid)
zonename_2 = Text("OUTDOOR")
X_3 = UnitX(Factor=text_width)
random_surface_with_correct_normal_2 = Surface(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)
move_3 = Move(Geometry=surface_centroid_2, Motion=X_3)  # -> Geometry, Transform
ln_2 = Line(StartPoint=surface_centroid_2, EndPoint=move_3.Geometry)
flip_2 = Flip(Surface=random_surface_with_correct_normal_2)  # -> Surface, Result
expression_15 = Expression(x=text_width, Expression="x / -2")
textsrf_2 = TextOnSurface(
    Text=zonename_2,
    Font="Sans Bold:no Italic:no",
    Height=text_height,
    Depth=text_depth,
    BaseLine=ln_2,
    BaseSurface=flip_2.Surface)
X_4 = UnitX(Factor=expression_15)
move_4 = Move(Geometry=textsrf_2, Motion=X_4)  # -> Geometry, Transform

area_4 = Area(Geometry=boundary_4)  # -> Area, Centroid
zonename_3 = Text("LIVING")
surface_centroid_3 = Data(area_4.Centroid)
random_surface_with_correct_normal_3 = Surface(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)
X_5 = UnitX(Factor=text_width)
move_5 = Move(Geometry=surface_centroid_3, Motion=X_5)  # -> Geometry, Transform
ln_3 = Line(StartPoint=surface_centroid_3, EndPoint=move_5.Geometry)
flip_3 = Flip(Surface=random_surface_with_correct_normal_3)  # -> Surface, Result
textsrf_3 = TextOnSurface(
    Text=zonename_3,
    Font="Sans Bold:no Italic:no",
    Height=text_height,
    Depth=text_depth,
    BaseLine=ln_3,
    BaseSurface=flip_3.Surface)

area_5 = Area(Geometry=item_3)  # -> Area, Centroid
surface_centroid_4 = Data(area_5.Centroid)
zonename_4 = Text("KITCHEN")
X_6 = UnitX(Factor=text_width)
random_surface_with_correct_normal_4 = Surface(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)
move_6 = Move(Geometry=surface_centroid_4, Motion=X_6)  # -> Geometry, Transform
ln_4 = Line(StartPoint=surface_centroid_4, EndPoint=move_6.Geometry)
flip_4 = Flip(Surface=random_surface_with_correct_normal_4)  # -> Surface, Result
textsrf_4 = TextOnSurface(
    Text=zonename_4,
    Font="Sans Bold:no Italic:no",
    Height=text_height,
    Depth=text_depth,
    BaseLine=ln_4,
    BaseSurface=flip_4.Surface)

area_6 = Area(Geometry=boundary_3)  # -> Area, Centroid
zonename_5 = Text("BEDROOM")
surface_centroid_5 = Data(area_6.Centroid)
random_surface_with_correct_normal_5 = Surface(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)
X_7 = UnitX(Factor=text_width)
move_7 = Move(Geometry=surface_centroid_5, Motion=X_7)  # -> Geometry, Transform
flip_5 = Flip(Surface=random_surface_with_correct_normal_5)  # -> Surface, Result
ln_5 = Line(StartPoint=surface_centroid_5, EndPoint=move_7.Geometry)
textsrf_5 = TextOnSurface(
    Text=zonename_5,
    Font="Sans Bold:no Italic:no",
    Height=text_height,
    Depth=text_depth,
    BaseLine=ln_5,
    BaseSurface=flip_5.Surface)

area_7 = Area(Geometry=boundary_5)  # -> Area, Centroid
zonename_6 = Text("CORRIDOR")
surface_centroid_6 = Data(area_7.Centroid)
random_surface_with_correct_normal_6 = Surface(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)
X_8 = UnitX(Factor=text_width)
move_8 = Move(Geometry=surface_centroid_6, Motion=X_8)  # -> Geometry, Transform
flip_6 = Flip(Surface=random_surface_with_correct_normal_6)  # -> Surface, Result
ln_6 = Line(StartPoint=surface_centroid_6, EndPoint=move_8.Geometry)
textsrf_6 = TextOnSurface(
    Text=zonename_6,
    Font="Sans Bold:no Italic:no",
    Height=text_height,
    Depth=text_depth,
    BaseLine=ln_6,
    BaseSurface=flip_6.Surface)

# ----
# unit_id label
boundingcurve = Curve(bounding_rectangle.Bounding)
random_surface_with_correct_normal_7 = Surface(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)
deconstruct_brep = DeconstructBrep(Brep=boundingcurve)  # -> Faces, Edges, Vertices
list_item = ListItem(List=flatten(deconstruct_brep.Edges), Index=2, Wrap=True)
curve_middle = CurveMiddle(Curve=list_item)
rotate = Rotate(Geometry=list_item, Angle=expr("180", degrees(1.570796327)), Plane=curve_middle)  # -> Geometry, Transform
unit_y = UnitY(Factor=1)
text_height_2 = Slider(0.6, range=0..1)
move_9 = Move(Geometry=rotate.Geometry, Motion=unit_y)  # -> Geometry, Transform
textsrf_7 = TextOnSurface(
    Text=unit_id_2,
    Font="Sans Bold:no Italic:no",
    Height=text_height,
    Depth=0.4,
    BaseLine=move_9.Geometry,
    BaseSurface=flip_6.Surface)
move_10 = Move(Geometry=textsrf_7, Motion=Vector(0, 0, 10))  # -> Geometry, Transform

area_8 = Area(Geometry=boundary_2)  # -> Area, Centroid
surface_centroid_7 = Data(area_8.Centroid)
zonename_7 = Text("BATH")
X_9 = UnitX(Factor=text_width)
random_surface_with_correct_normal_8 = Surface(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)
move_11 = Move(Geometry=surface_centroid_7, Motion=X_9)  # -> Geometry, Transform
ln_7 = Line(StartPoint=surface_centroid_7, EndPoint=move_11.Geometry)
flip_7 = Flip(Surface=random_surface_with_correct_normal_8)  # -> Surface, Result
expression_16 = Expression(x=text_width, Expression="x / -2")
textsrf_8 = TextOnSurface(
    Text=zonename_7,
    Font="Sans Bold:no Italic:no",
    Height=text_height,
    Depth=text_depth,
    BaseLine=ln_7,
    BaseSurface=flip_7.Surface)
X_10 = UnitX(Factor=expression_16)
move_12 = Move(Geometry=textsrf_8, Motion=X_10)  # -> Geometry, Transform

area_9 = Area(Geometry=boundary)  # -> Area, Centroid
surface_centroid_8 = Data(area_9.Centroid)
zonename_8 = Text("DINING")
X_11 = UnitX(Factor=text_width)
random_surface_with_correct_normal_9 = Surface(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)
move_13 = Move(Geometry=surface_centroid_8, Motion=X_11)  # -> Geometry, Transform
ln_8 = Line(StartPoint=surface_centroid_8, EndPoint=move_13.Geometry)
flip_8 = Flip(Surface=random_surface_with_correct_normal_9)  # -> Surface, Result
expression_17 = Expression(x=text_width, Expression="x / -2")
textsrf_9 = TextOnSurface(
    Text=zonename_8,
    Font="Sans Bold:no Italic:no",
    Height=text_height,
    Depth=text_depth,
    BaseLine=ln_8,
    BaseSurface=flip_8.Surface)
X_12 = UnitX(Factor=expression_17)
move_14 = Move(Geometry=textsrf_9, Motion=X_12)  # -> Geometry, Transform

# ----
# entity_subtype label
expression_18 = Expression(x=text_width, Expression="x / -2")
expression_19 = Expression(x=text_width, Expression="x / -2")
expression_20 = Expression(x=text_width, Expression="x / -2")
expression_21 = Expression(x=text_width, Expression="x / -2")
X_13 = UnitX(Factor=expression_18)
X_14 = UnitX(Factor=expression_19)
X_15 = UnitX(Factor=expression_20)
X_16 = UnitX(Factor=expression_21)
move_15 = Move(Geometry=textsrf_3, Motion=X_13)  # -> Geometry, Transform
move_16 = Move(Geometry=textsrf_5, Motion=X_14)  # -> Geometry, Transform
move_17 = Move(Geometry=textsrf_6, Motion=X_15)  # -> Geometry, Transform
move_18 = Move(Geometry=textsrf_4, Motion=X_16)  # -> Geometry, Transform

# ----
# DOOR AND WINDOWS
doors_boundaries_2 = Curve(pline_9)  # disabled
walls_boundaries_2 = Curve(region_difference)  # disabled

# ----
# ZONES GEOMETRY
bedrooms_boundary_2 = Curve(pline_3)  # disabled
corridor_boundary_2 = Curve(pline_5)  # disabled
outdoor_boundary_2 = Curve(pline_7)  # disabled
kitchen_boundary_2 = Curve(pline_6)  # disabled
dining_boundary_2 = Curve(pline)  # disabled
living_boundary_2 = Curve(pline_4)  # disabled
other_boundary_2 = Curve(pline_8)  # disabled
bath_boundary_2 = Curve(pline_2)  # disabled
area_10 = Area(Geometry=living_boundary_2)  # -> Area, Centroid; disabled

walls_boundaries_3 = Curve(walls_boundaries)
living_boundary_3 = Curve(living_boundary)
allzones_2 = Curve([corridor_boundary, bedrooms_boundary, living_boundary, kitchen_boundary, dining_boundary, outdoor_boundary, other_boundary, bath_boundary])

curve = Curve(living_boundary_3)
area_11 = Area(Geometry=curve)  # -> Area, Centroid
targetzonecurve = Curve(living_boundary_3)

# ----
# Centered Isovist Visualization
isovist_length_3 = Slider(10, range=0..20)
isovist_count_3 = Slider(255, range=2..258)
# Isovist Grid Points
walls_boundaries_4 = Curve(walls_boundaries_3)
onetestpoint = Point(area_11.Centroid)
point = Point(onetestpoint)
unit_x = UnitX(Factor=1)
xy_plane = XYPlane(Origin=point)
line_sdl = LineSDL(Start=point, Direction=unit_x, Length=isovist_length_3)
isovist = IsoVist(Plane=xy_plane, Count=isovist_count_3, Radius=isovist_length_3, Obstacles=flatten(walls_boundaries_4))  # -> Points, Distance, Index
polar_array = PolarArray(Geometry=line_sdl, Plane=xy_plane, Count=isovist_count_3, Angle=6.283185307)  # -> Geometry, Transform
polyline = PolyLine(Vertices=isovist.Points, Closed=False)
close_curve = CloseCurve(Curve=polyline, CloseType=0, Bulge=0.5, Tolerance=0)  # -> Closed, ResultBoolean
curves_to_trim = Curve(polar_array.Geometry)
boundary_surfaces = BoundarySurfaces(Edges=close_curve.Closed)
intersecting_curve = Curve(close_curve.Closed)
end_points = EndPoints(Curve=curves_to_trim)  # -> Start, End
point_2 = Point(graft(end_points.Start))
point_3 = Point(end_points.End)
curve_curve = CurveCurve(CurveA=curves_to_trim, CurveB=intersecting_curve)  # -> Points, ParamsA, ParamsB
closest_point = ClosestPoint(Point=point_2, Cloud=curve_curve.Points)  # -> ClosestPoint, CPIndex, Distance
line = Line(StartPoint=point_2, EndPoint=closest_point.ClosestPoint)
remove_duplicate_lines_karamba3d = RemoveDuplicateLinesKaramba3D(Line=line, LimitDistance=0.005)  # -> simplify(OutLine), Info, Indexes
end_points_2 = EndPoints(Curve=remove_duplicate_lines_karamba3d.OutLine)  # -> Start, End
onetestpoint_2 = Point(point)
preview_13 = CustomPreview(Geometry=boundary_surfaces, Material=ColourSwatch(SwatchColor=RGBA(255, 239, 15, 160)))
preview_14 = CustomPreview(Geometry=remove_duplicate_lines_karamba3d.OutLine, Material=ColourSwatch(SwatchColor=RGBA(51, 51, 51, 57)))
distance = Distance(PointA=onetestpoint_2, PointB=end_points_2.End)  # -> flatten(Distance)

# ----
# Grid assignment
bounding_rectangle_2 = BoundingRectangle(Geometry=flatten(allzones_2), Plane=PlaneXY(0, 0, 0), Axis=0, Slide=0, Union=True)  # -> Bounding, DimensionX, DimensionY
align_planes = AlignPlanes(Planes=bounding_rectangle_2.Bounding, Master=targetzonecurve)
multiplication = Multiplication(A=bounding_rectangle_2.DimensionX, B="5")
multiplication_2 = Multiplication(A=bounding_rectangle_2.DimensionY, B="5")
area_12 = Area(Geometry=bounding_rectangle_2.Bounding)  # -> Area, Centroid
bounding_rectangle_3 = BoundingRectangle(Geometry=flatten(allzones_2), Plane=align_planes, Axis=0, Slide=0, Union=True)  # -> Bounding, DimensionX, DimensionY
scale = Scale(Geometry=bounding_rectangle_3.Bounding, Center=area_12.Centroid, Factor=1.5)  # -> Geometry, Transform
deconstruct_brep_2 = DeconstructBrep(Brep=scale.Geometry)  # -> Faces, Edges, Vertices
point_4 = Point(deconstruct_brep_2.Vertices)
plane_2 = Plane(bounding_rectangle_3.Bounding)
move_to_point = MoveToPoint(Geometry=plane_2, PointA=plane_2, PointB=point_4)  # -> Moved, Vector, Transform
square = Square(Plane=move_to_point.Moved, Size=grid_spacing_meters_2, ExtentX=multiplication, ExtentY=multiplication_2)  # -> Cells, Points

bounding_box = Geometry(scale.Geometry)
brep = Brep(bounding_box)
ghpython_script_2 = GhPythonScript(update=button, bounding_box_brep=brep)  # -> view, a; inputs bounding_box_brep: Brep
# ---------- ghpython_script_2: Python ----------
__author__ = "Home PC"
__version__ = "2024.06.20"



import os
import System
import scriptcontext as sc
import Rhino as rc
import Rhino.Geometry as rg

def captureActiveView(width, height, zoom, bounding_box_brep):
    # Set the script context to the current Rhino doc
    sc.doc = rc.RhinoDoc.ActiveDoc
    
    # Get the active view and set image dimensions
    activeView = sc.doc.Views.ActiveView
    imageDim = System.Drawing.Size(width, height)
    
    # Get the active viewport
    viewport = activeView.ActiveViewport

    # Validate the Brep input
    if not isinstance(bounding_box_brep, rg.Brep):
        raise TypeError("Expected input to be a Brep")

    # Bake the bounding box Brep into the Rhino document
    bbox_id = sc.doc.Objects.AddBrep(bounding_box_brep)
    
    if bbox_id == System.Guid.Empty:
        raise Exception("Failed to bake the bounding box")

    # Perform zoom to the baked bounding box
    try:
        bbox_obj = sc.doc.Objects.Find(bbox_id)
        if bbox_obj:
            bbox = bbox_obj.Geometry.GetBoundingBox(True)
            if bbox.IsValid:
                viewport.ZoomBoundingBox(bbox)
            else:
                raise Exception("Bounding box is not valid")
    finally:
        # Delete the baked bounding box
        sc.doc.Objects.Delete(bbox_id, True)
        sc.doc.Views.Redraw()

    # Perform the capture
    try:
        imageCap = activeView.CaptureToBitmap(imageDim)
        return imageCap
    except Exception as e:
        raise Exception("Capture failed: " + str(e))

# Example usage:
# Define your camera settings before calling captureActiveView
width = 1250
height = 800
zoom = 120

# 'bounding_box_brep' is an input parameter from Grasshopper
a = captureActiveView(width, height, zoom, bounding_box_brep)
# ---------- end ghpython_script_2 ----------

previmg = PrevImage(SmartBitmap=ghpython_script_2.a)

# ---- group: Inserting of Points within a Boundary Curve
area_13 = Area(Geometry=square.Cells)  # -> Area, Centroid
point_5 = Point(area_13.Centroid)
point_in_curves = PointInCurves(Point=point_5, Curves=targetzonecurve)  # -> Relationship, Index, Point
cull_pattern = CullPattern(List=point_5, CullPattern=point_in_curves.Relationship)
point_6 = Point(cull_pattern)
curve_closest_point = CurveClosestPoint(Point=point_6, Curve=targetzonecurve)  # -> Point, Parameter, Distance
distance_2 = Distance(PointA=point_6, PointB=curve_closest_point.Point)
smaller_than = SmallerThan(FirstNumber=distance_2, SecondNumber=min_distance_from_wall_2)  # -> SmallerThan, OrEqualTo
dispatch_14 = Dispatch(List=point_6, DispatchPattern=smaller_than.SmallerThan)  # -> ListA, ListB
testgrid = Point(dispatch_14.ListB)
expression_22 = Expression(x=grid_spacing_meters_2, Expression="(x*2^½)/2")
expression_23 = Expression(x=grid_spacing_meters_2, Expression="x/2")
polygon = Polygon(Plane=testgrid, Radius=expression_23, Segments=4, FilletRadius=0)  # -> Polygon, Length
area_14 = Area(Geometry=polygon.Polygon)  # -> Area, Centroid
boundary_surfaces_2 = BoundarySurfaces(Edges=polygon.Polygon)
rotate_2 = Rotate(Geometry=boundary_surfaces_2, Angle=degrees(45), Plane=area_14.Centroid)  # -> Geometry, Transform

# ----
walls_boundaries_5 = Curve(walls_boundaries_3)

# ---- group: TEST POINTS
test_points = Point(testgrid)

# ----
alltestpoints = Point(test_points)
point_7 = Point(alltestpoints)
unit_x_2 = UnitX(Factor=1)
xy_plane_2 = XYPlane(Origin=point_7)
line_sdl_2 = LineSDL(Start=point_7, Direction=unit_x_2, Length=isovist_length_2)
polar_array_2 = PolarArray(Geometry=line_sdl_2, Plane=xy_plane_2, Count=isovist_count_2, Angle=6.283185307)  # -> Geometry, Transform

isovist_2 = IsoVist(Plane=xy_plane_2, Count=isovist_count_2, Radius=isovist_length_2, Obstacles=flatten(walls_boundaries_5))  # -> Points, Distance, Index
polyline_2 = PolyLine(Vertices=isovist_2.Points, Closed=False)
close_curve_2 = CloseCurve(Curve=polyline_2, CloseType=0, Bulge=0.5, Tolerance=0)  # -> Closed, ResultBoolean

intersecting_curve_2 = Curve(close_curve_2.Closed)
curves_to_trim_2 = Curve(polar_array_2.Geometry)
end_points_3 = EndPoints(Curve=curves_to_trim_2)  # -> Start, End
curve_curve_2 = CurveCurve(CurveA=curves_to_trim_2, CurveB=intersecting_curve_2)  # -> Points, ParamsA, ParamsB
point_8 = Point(graft(end_points_3.Start))
closest_point_2 = ClosestPoint(Point=point_8, Cloud=curve_curve_2.Points)  # -> ClosestPoint, CPIndex, Distance
line_2 = Line(StartPoint=point_8, EndPoint=closest_point_2.ClosestPoint)
remove_duplicate_lines_karamba3d_2 = RemoveDuplicateLinesKaramba3D(Line=line_2, LimitDistance=0.005)  # -> simplify(OutLine), Info, Indexes

# ---- group: Test Curve
isovist_count_4 = Slider(10, range=10..50)
list_item_2 = ListItem(List=flatten(remove_duplicate_lines_karamba3d_2.OutLine), Index=isovist_count_4, Wrap=True)

# ----
preview_15 = CustomPreview(Geometry=remove_duplicate_lines_karamba3d_2.OutLine, Material=ColourSwatch(SwatchColor=RGBA(51, 51, 51, 57)))

# ----
# ZONES GEOMETRY
numberofrays = Number(isovist_count_2)
isovistlines = Line(remove_duplicate_lines_karamba3d_2.OutLine)
bedrooms_boundary_3 = Curve(pline_3)
dining_boundary_3 = Curve(pline)
kitchen_boundary_3 = Curve(pline_6)
outdoor_boundary_3 = Curve(pline_7)
corridor_boundary_3 = Curve(pline_5)
other_boundary_3 = Curve(pline_8)
living_boundary_4 = Curve(pline_4)
bath_boundary_3 = Curve(pline_2)
panel_17 = Panel(numberofrays)

# ----
# Total number of test points
test_points_2 = Point(simplify(point_7))
clean_tree = CleanTree(RemoveNulls=True, RemoveInvalid=True, RemoveEmpty=True, Tree=test_points_2)  # -> flatten(Tree)
list_length = ListLength(List=clean_tree)  # -> flatten(Length)
total_number_of_test_points = Panel(list_length)

# ----
# Miscellaneous
gridpoints = Point(test_points_2)
flatten_tree = FlattenTree(Tree=gridpoints, Path="{0}")
list_length_2 = ListLength(List=flatten_tree)  # -> flatten(Length)
unit_id_3 = Data(item_2)
ghpython_script_3 = GhPythonScript(number_to_test=flatten(list_length_2), unit_id=flatten(unit_id_3))  # -> out, output
# ---------- ghpython_script_3: Python ----------
__author__ = "Home PC"
__version__ = "2024.06.14"

import rhinoscriptsyntax as rs



def check_geometry(unit_id, number_to_test):
    # Check if the number_to_test is equal to 0
    if number_to_test == 0:
        return "Unit_id {}: INVALID GEOMETRY".format(unit_id)
    else:
        return "Unit_id {}: VALID GEOMETRY".format(unit_id)

# Run the function with the inputs
output = check_geometry(unit_id, number_to_test)
# ---------- end ghpython_script_3 ----------
warning = Panel(ghpython_script_3.output)

tree_branch = TreeBranch(Tree=simplify(kitchen_boundary_3), Path="{0}", MaintainPaths=True)
kitchenbounday = Curve(tree_branch)
diningboundary = Curve(dining_boundary_3)
cluster = Cluster(curve_a=isovistlines, curve_b=diningboundary)
cluster_2 = Cluster(curve_a=isovistlines, curve_b=kitchenbounday)

totalnumberoftestpoints = Data(list_length)
isovistlines_2 = Line(isovistlines)

total_number_of_test_points_2 = Panel(totalnumberoftestpoints)
number_of_points_where_condition_is_sati = Panel(cluster)  # "NUMBER OF POINTS WHERE CONDITION IS SATISFIED"
expression_24 = Expression(x=number_of_points_where_condition_is_sati, y=total_number_of_test_points_2, Expression="(x / y)")
of_test_points_with_clear_lines_of_sight = Panel(expression_24)

replace_nulls = ReplaceNulls(Items=expression_24, Replacements="0")  # -> flatten(Items), Count

# ----
# Write DataTree to Excel
door_visibility_radius = Slider(0.412, range=0.1..1)
explode_tree = ExplodeTree(Data=bedrooms_boundary_3)  # -> Branch0, Branch1, Branch2, Branch3, Branch4, Branch5

# ----
# LIVING --> DINING
expression_25 = Expression(x=cluster_2, y=total_number_of_test_points_2, Expression="(x / y)")
of_test_points_with_clear_lines_of_sight_2 = Panel(expression_25)
replace_nulls_2 = ReplaceNulls(Items=expression_25, Replacements="0")  # -> flatten(Items), Count

living_kitchen_2 = DataRecorder(replace_nulls_2.Items, DataLimit=-10, RecordData=True)
livedata_do_not_internalize_2 = Data(living_kitchen_2)

# ----
# SIGHTLINE TO KITCHEN
# SIGHTLINE TO BATHROOMS
living_kitchen_3 = Data(livedata_do_not_internalize_2)
panel_18 = Panel(living_kitchen_3)
reverse_list_2 = ReverseList(List=living_kitchen_3)
panel_19 = Panel(reverse_list_2)

unit_id_data_recorder_2 = Data(livedata_do_not_internalize)
unit_id_4 = Panel(unit_id_data_recorder_2)
reverse_list_3 = ReverseList(List=unit_id_4)
unit_id_5 = Panel(reverse_list_3)

warning_for_invalid_geometries = Panel(ghpython_script_3.output)

valid_invalid_geometry = DataRecorder(warning_for_invalid_geometries, DataLimit=-10, RecordData=True)
livedata_do_not_internalize_3 = Data(valid_invalid_geometry)

valid_invalid_geometry_data_recorder_2 = Data(livedata_do_not_internalize_3)
valid_invalid_geometry_2 = Panel(valid_invalid_geometry_data_recorder_2)
reverse_list_4 = ReverseList(List=valid_invalid_geometry_data_recorder_2)
valid_invalid_geometry_3 = Panel(reverse_list_4)

# ----
# Reverse the list before saving the data
reverse_list_5 = ReverseList(List=livedata_do_not_internalize)
reverse_list_6 = ReverseList(List=livedata_do_not_internalize_2)
reverse_list_7 = ReverseList(List=livedata_do_not_internalize_3)

# ----
# Copy Name
# Day Month Year
internalize_15 = Data(reverse_list_5)
internalize_16 = Data(reverse_list_6)
internalize_17 = Data(reverse_list_7)
unit_id_data_recorder_3 = Data(internalize_15)
living_kitchen_4 = Data(internalize_16)
valid_invalid_geometry_data_recorder_3 = Data(internalize_17)

# ----
# Copy Name
# Day Month Year
internalize_18 = Data(reverse_list_6)
internalize_19 = Data(reverse_list_5)
internalize_20 = Data(reverse_list_7)
valid_invalid_geometry_data_recorder_4 = Data(internalize_20)
unit_id_data_recorder_4 = Data(internalize_19)
living_kitchen_5 = Data(internalize_18)

unit_id_6 = Panel(unit_id_data_recorder_4)
living_to_kitchen_sightlines = Panel(living_kitchen_5)

# ----
# BEDROOM DOORS
_0_5_to_0_5_13 = Slider(-0.1, range=-0.5..0.5)  # disabled
bedrooms_boundary_4 = Data(flatten(arrangelayer_3))  # disabled
corridor_boundary_4 = Data(arrangelayer_5)  # disabled
doors = Data(arrangelayer_9)  # disabled
arrangelayer_13 = ArrangeLayer(G=bedrooms_boundary_4, F=_0_5_to_0_5_13)  # disabled
arrangelayer_14 = ArrangeLayer(G=corridor_boundary_4, F=_0_5_to_0_5_13)  # disabled
number_slider_4 = Slider(0.523, range=0..1)  # disabled
join_curves_3 = JoinCurves(Curves=arrangelayer_13, Preserve=False)  # -> flatten(Curves); disabled
join_curves_4 = JoinCurves(Curves=doors, Preserve=False)  # -> flatten(Curves); disabled
boundary_surfaces_3 = BoundarySurfaces(Edges=join_curves_4)  # disabled
unit_z = UnitZ(Factor=number_slider_4)  # disabled
boundary_surfaces_4 = BoundarySurfaces(Edges=join_curves_3)  # disabled
number_slider_5 = Slider(1.141, range=1..2)  # disabled
number_slider_6 = Slider(1.053, range=1..2)  # disabled
panel_20 = Panel(arrangelayer_13)  # disabled
extrude = Extrude(Base=boundary_surfaces_3, Direction=unit_z)  # disabled
area_15 = Area(Geometry=extrude)  # -> Area, Centroid; disabled
area_16 = Area(Geometry=corridor_boundary_4)  # -> Area, Centroid; disabled
list_length_3 = ListLength(List=flatten(area_16.Centroid))  # disabled
extrude_2 = Extrude(Base=boundary_surfaces_4, Direction=unit_z)  # disabled
area_17 = Area(Geometry=extrude_2)  # -> Area, Centroid; disabled
cap_holes = CapHoles(Brep=extrude_2)  # disabled
cap_holes_2 = CapHoles(Brep=extrude)  # disabled
scale_2 = Scale(Geometry=cap_holes_2, Center=area_15.Centroid, Factor=number_slider_5)  # -> Geometry, Transform; disabled
scale_3 = Scale(Geometry=cap_holes, Center=area_17.Centroid, Factor=number_slider_6)  # -> Geometry, Transform; disabled
plane_3 = Plane([join_curves_3, join_curves_4])  # disabled
bedroom_zones = Mesh(scale_3.Geometry)  # disabled
doors_2 = Mesh(scale_2.Geometry)  # disabled
curve_curve_3 = CurveCurve(CurveA=join_curves_4, CurveB=join_curves_3)  # -> Points, ParamsA, ParamsB; disabled
mesh = Mesh([doors_2, bedroom_zones])  # disabled
mesh_intersection = MeshIntersection(MeshesA=doors_2, MeshesB=bedroom_zones)  # disabled
join_curves_5 = JoinCurves(Curves=arrangelayer_14, Preserve=False)  # -> flatten(Curves); disabled
number_slider_7 = Slider(1.161, range=1..2)  # disabled
number_slider_8 = Slider(1.074, range=1..2)  # disabled
boundary_surfaces_5 = BoundarySurfaces(Edges=join_curves_5)  # disabled
extrude_3 = Extrude(Base=boundary_surfaces_5, Direction=unit_z)  # disabled
area_18 = Area(Geometry=boundary_surfaces_5)  # -> Area, Centroid; disabled
cap_holes_3 = CapHoles(Brep=extrude_3)  # disabled
scale_4 = Scale(Geometry=cap_holes_3, Center=area_18.Centroid, Factor=number_slider_7)  # -> Geometry, Transform; disabled
mesh_2 = Mesh(scale_4.Geometry)  # disabled
mesh_difference = MeshDifference(MeshesA=mesh_2, MeshesB=doors_2)  # disabled
mesh_intersection_2 = MeshIntersection(MeshesA=mesh_2, MeshesB=bedroom_zones)  # disabled
mesh_intersection_3 = MeshIntersection(MeshesA=mesh_2, MeshesB=mesh_intersection)  # disabled
area_19 = Area(Geometry=mesh_intersection_2)  # -> Area, Centroid; disabled
area_20 = Area(Geometry=mesh_intersection_3)  # -> Area, Centroid; disabled
list_length_4 = ListLength(List=area_20.Centroid)  # -> flatten(Length); disabled
scale_5 = Scale(Geometry=mesh_intersection_2, Center=area_19.Centroid, Factor=number_slider_8)  # -> Geometry, Transform; disabled
mass_addition = MassAddition(Input=list_length_4)  # -> Result, PartialResults; disabled
subtraction_3 = Subtraction(A=mass_addition.Result, B=1)  # disabled
mesh_join = MeshJoin(Meshes=scale_5.Geometry)  # disabled
mesh_intersection_4 = MeshIntersection(MeshesA=mesh_join, MeshesB=doors_2)  # disabled
expression_26 = Expression(x=subtraction_3, Expression="If(x=0, 1,x)")  # disabled
number_slider_9 = Slider(0.3, range=0..1)  # disabled
mesh_join_2 = MeshJoin(Meshes=mesh_2)  # disabled
range = Range(Domain=subtraction_3, Steps=expression_26)  # disabled
colour_swatch = ColourSwatch(SwatchColor=RGB(0, 255, 47))  # disabled
panel_21 = Panel("0.5")  # disabled
unit_z_2 = UnitZ(Factor=panel_21)  # disabled

area_21 = Area(Geometry=bounding_rectangle.Bounding)  # -> Area, Centroid; disabled
corridorcoordinatelist = Relay([area_16.Centroid, area_21.Centroid])  # disabled
addition = Addition(A=list_length_3, B=1)  # disabled
deconstruct = Deconstruct(Point=flatten(corridorcoordinatelist))  # -> XComponent, YComponent, ZComponent; disabled
integer = Integer(addition)  # disabled
panel_22 = Panel("0")  # disabled
mass_addition_2 = MassAddition(Input=deconstruct.XComponent)  # -> Result, PartialResults; disabled
mass_addition_3 = MassAddition(Input=deconstruct.YComponent)  # -> Result, PartialResults; disabled
mass_addition_4 = MassAddition(Input=deconstruct.ZComponent)  # -> Result, PartialResults; disabled
construct_point = ConstructPoint(XCoordinate=mass_addition_2.Result, YCoordinate=mass_addition_3.Result, ZCoordinate=panel_22)  # disabled
division = Division(A=construct_point, B=integer)  # disabled
point_9 = Point(division)  # disabled
panel_23 = Panel(point_9)  # disabled

distance_3 = Distance(PointA=area_20.Centroid, PointB=point_9)  # disabled
sort_list = SortList(Keys=distance_3, ValuesValuesA=area_20.Centroid)  # -> Keys, ValuesValuesA; disabled
list_item_3 = ListItem(List=flatten(sort_list.ValuesValuesA), Index=range, Wrap=False)  # disabled
polygon_2 = Polygon(Plane=list_item_3, Radius=number_slider_9, Segments=6, FilletRadius=0)  # -> Polygon, Length; disabled
boundary_surfaces_6 = BoundarySurfaces(Edges=polygon_2.Polygon)  # disabled
list_length_5 = ListLength(List=polygon_2.Polygon)  # disabled
subtraction_4 = Subtraction(A=list_length_5, B=mass_addition.Result)  # disabled
expression_27 = Expression(x=subtraction_4, w=subtraction_4, v=list_length_5, Expression="If(x≥1, w,v)")  # disabled
number_of_doors = Panel(expression_27)  # disabled
move_19 = Move(Geometry=boundary_surfaces_6, Motion=unit_z_2)  # -> Geometry, Transform; disabled
custom_preview = CustomPreview(Geometry=move_19.Geometry, Material=colour_swatch)  # disabled

# ----
# Manually inspect all area sub_entities
_9_entity_subtype_12 = Data(bang_2.Branch9)

# ----
# ENTITY_SUBTYPE SELECTION
number_slider_10 = Slider(5, range=0..20)
_9_entity_subtype_13 = Data(_9_entity_subtype_12)
cset_2 = CreateSet(List=_9_entity_subtype_13)  # -> Set, Map
item_4 = ListItem(List=cset_2.Set, Index=number_slider_10, Wrap=False)
expression_28 = Expression(x=_9_entity_subtype_13, y=item_4, Expression="x = Y")
selection = Panel(item_4)
geometry_path = Panel("10")
branch = TreeBranch(Tree=unit_id_selection, Path=geometry_path, MaintainPaths=True)
dispatch_15 = Dispatch(List=branch, DispatchPattern=expression_28)  # -> ListA, ListB
python_14 = GhPythonScript(wkt_polygon=dispatch_15.ListA)  # -> out, pt_list; same code as python
pt_13 = Point(python_14.pt_list)
pline_13 = PolyLine(Vertices=pt_13, Closed=False)

boundary_13 = BoundarySurfaces(Edges=pline_13)

# ----
# Extract center lines of polylines
# 
# Laurent Delrieu
# 
# https://discourse.mcneel.com/t/extract-centreline-of-polylines/85133/6
# 
# 
# Laurent Delrieu
# 30/12/2017
# l.delrieu@neuf.fr
# 
# http://www.grasshopper3d.com/forum/topics/sand-dune-medial-axis-sample
# https://discourse.mcneel.com/t/old-town-roofs/51634
# WARNING  : it is sensitive to tolerances inside Rhino
corridor_boundary_5 = Curve(corridor_boundary_2)  # disabled
number_slider_11 = Slider(50, range=10..100)  # disabled
number_slider_12 = Slider(0.71, range=0..3)  # disabled
explode_tree_2 = ExplodeTree(Data=corridor_boundary_5)  # -> Branch0, Branch1, Branch2, Branch3, Branch4, Branch5; disabled
number_slider_13 = Slider(1, range=0..4)  # disabled
number_slider_14 = Slider(2, range=0..4)  # disabled
plane_orientation_of_floor_plan = Plane(bounding_rectangle_3.Bounding)  # disabled
planeedges = Curve(deconstruct_brep_2.Edges)  # disabled
list_item_4 = ListItem(List=planeedges, Index=number_slider_13, Wrap=True)  # disabled
length = Length(Curve=list_item_4)  # disabled
list_item_5 = ListItem(List=planeedges, Index=number_slider_14, Wrap=True)  # disabled
length_2 = Length(Curve=list_item_5)  # disabled
average = Average(Input=[length, length_2])  # disabled
division_2 = Division(A=average, B=number_slider_11)  # disabled
panel_24 = Panel(division_2)  # disabled
number_slider_15 = Slider(0.12, range=0..1)  # disabled
panel_25 = Panel("1")  # disabled
number_slider_16 = Slider(0.3, range=0.05..3)  # disabled
panel_26 = Panel("0")  # disabled
unit_vector = UnitVector(Vector=list_item_4)  # disabled
unit_vector_2 = UnitVector(Vector=list_item_4)  # disabled
unit_vector_3 = UnitVector(Vector=list_item_4)  # disabled
unit_x_3 = UnitX(Factor=1)  # disabled
unit_vector_4 = UnitVector(Vector=list_item_4)  # disabled
unit_vector_5 = UnitVector(Vector=list_item_4)  # disabled
join_curves_6 = JoinCurves(Curves=corridor_boundary_5, Preserve=False)  # disabled
curve_2 = Curve(<curve referenced from the Rhino model>)  # disabled
interior_simplification_unitless = Slider(0.165, range=0.01..0.3)  # disabled
curve_extension_unitless = Slider(0.438, range=0.01..0.5)  # disabled
crv = Curve(curve_2)  # disabled
graft = GraftTree(Tree=crv, IncludeEmptyLists=True, IncludeNullItems=True)  # disabled
panel_27 = Panel("90")  # disabled
bbox = BoundingBox(Content=graft, Plane=PlaneXY(0, 0, 0))  # -> Box, Box_2; disabled
boxprop = BoxProperties(Box=bbox.Box)  # -> Center, Diagonal, Area, Volume, Degeneracy; disabled
prox_network = Line()  # disabled
pdecon = Deconstruct(Point=boxprop.Diagonal)  # -> XComponent, YComponent, ZComponent; disabled
vlen = VectorLength(Vector=boxprop.Diagonal)  # disabled
explode_tree_3 = ExplodeTree(Data=kitchen_boundary_2)  # -> Branch0, Branch1, Branch2, Branch3, Branch4, Branch5, Branch6, Branch7; disabled
area_22 = Area(Geometry=doors_boundaries_2)  # -> Area, flatten(Centroid); disabled
min = Minimum(A=pdecon.XComponent, B=pdecon.YComponent)  # disabled
swatch = ColourSwatch(SwatchColor=RGB(0, 0, 0))  # disabled
area_23 = Area(Geometry=bath_boundary_2)  # -> Area, Centroid; disabled
area_24 = Area(Geometry=explode_tree_3.Branch0)  # -> Area, Centroid; disabled
rad = Radians(Degrees=number_slider_2)  # disabled
previewlw = CustomPreviewLineweights(Geometry=graft, Shader=swatch, Thickness=3, Absolute=False)  # disabled
multiplication_3 = Multiplication(A=curve_simplification_unitless, B=vlen)  # disabled
multiplication_4 = Multiplication(A=curve_extension_unitless, B=vlen)  # disabled
multiplication_5 = Multiplication(A=interior_simplification_unitless, B=min)  # disabled
simplify = SimplifyCurve(Curve=graft, Tolerance=multiplication_3, AngleTolerance=rad)  # -> flatten(Curve), Simplified; disabled
cp = ControlPoints(Curve=simplify.Curve)  # -> Points, Weights, Knots; disabled
c_script = CSharpScript(polylines=simplify.Curve, types=list)  # -> out, roofs; inputs polylines: list of Polyline, types: list of Int32; disabled
# ---------- c_script: C# ----------
    //Medial Axis
    //Laurent Delrieu
    //30 / 12 / 2017
    //l.delrieu@neuf.fr

    //Fit the number of roof types with the number of roofs (polylines)
    if (types.Count < polylines.Count)
    {
      if (types.Count > 0)
      {
        for (int i = (types.Count - 1); i < polylines.Count; i++)
        {
          types.Add(types[types.Count - 1]);
        }
        Component.AddRuntimeMessage(GH_RuntimeMessageLevel.Warning, "All types are set to last type");
      }
      else
      {
        for (int i = 0; i < polylines.Count; i++)
        {
          types.Add(0);
        }
        Component.AddRuntimeMessage(GH_RuntimeMessageLevel.Warning, "All types are set to round");
      }
    }
    //Datatree to store roofs brep/surfaces
    DataTree<Brep> roofsDT = new   DataTree<Brep>();

    //Parallel for
    System.Threading.Tasks.Parallel.For(0, polylines.Count,
      index => {
      bool parallel = true;
      roofsDT.AddRange(SandDune(polylines[index], types[index], false, parallel), new GH_Path(index));
      });

    roofs = roofsDT;
# ---------- c_script: C# additional code ----------
  //Calculation of 45° roof with differents valley
  //Type = 0 => Round : Constant slope (sand)
  //Type = 1 => Butt  : Angular (roof)
  //Type = 2 => Square : Simple
  public List<Brep> SandDune(Polyline polyline, int type, bool isV6, bool parallel)
  {
    List<Brep> output = new List<Brep>();

    //By default round type
    if (type < 0) type = 0;
    if (type > 2) type = 0;

    if (polyline != null)
    {
      double tol = RhinoDoc.ActiveDoc.ModelAbsoluteTolerance;
      bool isClosed = polyline.IsClosedWithinTolerance(tol);
      //Polyline is closed if not closed
      if (!isClosed)
      {
        polyline.Add(polyline[0]);
      }
      //Just in case
      polyline.CollapseShortSegments(tol * 2);
      Curve polylineCurve = polyline.ToNurbsCurve();

      //Definition of orientation of polyline
      int orientation = 1;
      if (isV6)
      {
        //CurveOrientation (inverted in RH5 vs RH6
        // Undefined          0 Orientation is undefined.
        // Clockwise         -1 The curve's orientation is clockwise in the xy plane.
        // CounterClockwise   1 The curve's orientation is counter clockwise in the xy plane
        CurveOrientation curveOrientation = polylineCurve.ClosedCurveOrientation(Plane.WorldXY);
        if (curveOrientation == CurveOrientation.Clockwise) orientation = -1;
        else orientation = 1;
      }
      else
      {
        //Use of classical surface calculation of polyline
        if (SurfaceOnXYplane(polyline) > 0)  orientation = -1;
        else orientation = 1;
      }

      //Bounding box calculation in order to have the max horizontal distances for the roofs surfaces (before cut)
      BoundingBox bb = polylineCurve.GetBoundingBox(false);
      double maxLength = bb.Diagonal.Length;

      //List of brep representing the roof before cut
      List<Brep> breps = new List<Brep>();
      //Side of roof
      for (int i = 0; i < (polyline.Count - 1); i++)
      {
        //Calculate direction of line
        Point3d p1 = polyline[i];
        Point3d p2 = polyline[(i + 1)];
        Vector3d direction12 = (p2 - p1) * orientation;
        direction12.Unitize();
        //Calculate a perpendicular
        Vector3d perp12 = Vector3d.CrossProduct(direction12, Vector3d.ZAxis);
        perp12.Unitize();
        //Because move is one unit horizontal (per12) + one unit in Z => 45°
        //if you want other angle put a coefficient on perp12 (0 => 90°)
        Vector3d move = perp12 + Vector3d.ZAxis;
        move *= maxLength;

        //Make a sweep
        var sweep = new Rhino.Geometry.SweepOneRail();
        sweep.AngleToleranceRadians = RhinoDoc.ActiveDoc.ModelAngleToleranceRadians;
        sweep.ClosedSweep = false;
        sweep.SweepTolerance = RhinoDoc.ActiveDoc.ModelAbsoluteTolerance;

        Brep[] sideBreps = sweep.PerformSweep(new LineCurve(p1, p1 + move), new LineCurve(p1, p2));
        if (sideBreps.Length > 0) breps.Add(sideBreps[0]);
      }

      //Valley parts of the roof
      for (int i = 0; i < (polyline.Count - 1); i++)
      {
        //Calculate direction of line
        int index;
        if (i == 0)
        {
          index = polyline.Count - 2;
        }
        else
        {
          index = i - 1;
        }
        Point3d p1 = polyline[index];
        Point3d p2 = polyline[i];
        Point3d p3 = polyline[i + 1];

        Vector3d direction12 = (p2 - p1);
        direction12.Unitize();
        Vector3d direction23 = (p3 - p2);
        direction23.Unitize();

        Brep rp = new Brep();
        //Round type
        if (type == 0)
        {
          rp = ValleyRound(p2, direction12, direction23, maxLength, orientation);
          if (rp.IsValid) breps.Add(rp);
        }
        //Butt type
        if (type == 1)
        {
          Brep[] vv = ValleyButt(p2, direction12, direction23, maxLength, orientation);
          if (vv.Length >= 2)
          {
            if (vv[0].IsValid) breps.Add(vv[0]);
            if (vv[1].IsValid) breps.Add(vv[1]);
          }
        }
        //Square type
        if (type == 2)
        {
          rp = ValleySquare(p2, direction12, direction23, maxLength, orientation);
          if (rp.IsValid) breps.Add(rp);
        }
      }
      output = CutBreps(breps, tol, polylineCurve, parallel);
    }
    return output;
  }
  public Brep ValleyRound(Point3d p2, Vector3d v12, Vector3d v23, double maxLength, int orientation)
  {
    Brep output = new Brep();
    Vector3d vv = Vector3d.CrossProduct(v12, v23);
    if (vv.Z * orientation > 0)
    {
      Vector3d perp12 = Vector3d.CrossProduct(v12, Vector3d.ZAxis * orientation);
      perp12.Unitize();
      Vector3d move12 = perp12 + Vector3d.ZAxis;
      move12 *= maxLength;

      Vector3d perp23 = Vector3d.CrossProduct(v23, Vector3d.ZAxis * orientation);
      perp23.Unitize();
      Vector3d move23 = perp23 + Vector3d.ZAxis;
      move23 *= maxLength;

      Arc arc = new Arc(p2 + move12, v12, p2 + move23);

      var sweep = new Rhino.Geometry.SweepTwoRail();
      sweep.AngleToleranceRadians = RhinoDoc.ActiveDoc.ModelAngleToleranceRadians;
      sweep.ClosedSweep = false;
      sweep.SweepTolerance = RhinoDoc.ActiveDoc.ModelAbsoluteTolerance;

      Brep[] sideBreps = sweep.PerformSweep(new LineCurve(p2 + move12, p2), new LineCurve(p2 + move23, p2), arc.ToNurbsCurve());
      if (sideBreps.Length > 0) output = sideBreps[0];
    }
    return output;
  }

  //Butt valley
  public Brep[] ValleyButt(Point3d p2, Vector3d v12, Vector3d v23, double maxLength, int orientation)
  {
    Brep[] output = new Brep[2];
    output[0] = new Brep();
    output[1] = new Brep();

    Vector3d vv = Vector3d.CrossProduct(v12, v23);
    if (vv.Z * orientation > 0)
    {
      Vector3d perp12 = Vector3d.CrossProduct(v12, Vector3d.ZAxis * orientation);
      perp12.Unitize();
      Vector3d move12 = perp12 + Vector3d.ZAxis;
      move12 *= maxLength;

      Vector3d perp23 = Vector3d.CrossProduct(v23, Vector3d.ZAxis * orientation);
      perp23.Unitize();
      Vector3d move23 = perp23 + Vector3d.ZAxis;
      move23 *= maxLength;

      Line l12 = new Line(p2 + move12, v12);
      Line l23 = new Line(p2 + move23, v23);

      Point3d pmid = p2 + (move23 + move12) / 2;
      double a, b;
      if (Rhino.Geometry.Intersect.Intersection.LineLine(l12, l23, out a, out b, 0.01, false))
      {
        pmid = l12.PointAt(a);
      }
      var sweep = new Rhino.Geometry.SweepTwoRail();
      sweep.AngleToleranceRadians = RhinoDoc.ActiveDoc.ModelAngleToleranceRadians;
      sweep.ClosedSweep = false;
      sweep.SweepTolerance = RhinoDoc.ActiveDoc.ModelAbsoluteTolerance;

      Brep[] sideBreps = sweep.PerformSweep(new LineCurve(p2 + move12, p2), new LineCurve(pmid, p2), new LineCurve(p2 + move12, pmid));
      if (sideBreps.Length > 0) output[0] = sideBreps[0];

      sideBreps = sweep.PerformSweep(new LineCurve(pmid, p2), new LineCurve(p2 + move23, p2), new LineCurve(pmid, p2 + move23));
      if (sideBreps.Length > 0) output[1] = sideBreps[0];
    }
    return output;
  }

  //Square Valley
  public Brep ValleySquare(Point3d p2, Vector3d v12, Vector3d v23, double maxLength, int orientation)
  {
    Brep output = new Brep();
    Vector3d vv = Vector3d.CrossProduct(v12, v23);
    if (vv.Z * orientation > 0)
    {
      Vector3d perp12 = Vector3d.CrossProduct(v12, Vector3d.ZAxis * orientation);
      perp12.Unitize();
      Vector3d move12 = perp12 + Vector3d.ZAxis;
      move12 *= maxLength;

      Vector3d perp23 = Vector3d.CrossProduct(v23, Vector3d.ZAxis * orientation);
      perp23.Unitize();
      Vector3d move23 = perp23 + Vector3d.ZAxis;
      move23 *= maxLength;


      var sweep = new Rhino.Geometry.SweepTwoRail();
      sweep.AngleToleranceRadians = RhinoDoc.ActiveDoc.ModelAngleToleranceRadians;
      sweep.ClosedSweep = false;
      sweep.SweepTolerance = RhinoDoc.ActiveDoc.ModelAbsoluteTolerance;

      Brep[] sideBreps = sweep.PerformSweep(new LineCurve(p2 + move12, p2), new LineCurve(p2 + move23, p2), new LineCurve(p2 + move12, p2 + move23));
      if (sideBreps.Length > 0) output = sideBreps[0];
    }
    return output;
  }

  //Cut the roof complete surface with curves
  //Example here
  //  https://discourse.mcneel.com/t/splitting-a-brep-by-a-curve-rhinocommon/17435/2
  public List<Brep> CutBreps(List<Brep> breps, double tol, Curve curve, bool parallel)
  {
    List<Brep> output = new List<Brep>();

    if (parallel)
    {
      System.Threading.Tasks.Parallel.For(0, breps.Count,
        i => {
        List<Curve> curves = BrepsCurvesIntersection(breps, i, tol, parallel);

        List<Brep> bb = new List<Brep>();
        BrepFace bf = breps[i].Faces[0];
        Brep split = bf.Split(curves, tol);
        if (split != null)
        {
          foreach(BrepFace splitFace in split.Faces)
          {
            bb.Add(splitFace.DuplicateFace(false));
          }
        }
        output.AddRange(LowerBrep(bb, curve, tol));
        });
    }
    else
    {
      //Not parallel
      for (int i = 0; i < breps.Count; i++)
      {
        List<Curve> curves = BrepsCurvesIntersection(breps, i, tol, parallel);

        List<Brep> bb = new List<Brep>();
        BrepFace bf = breps[i].Faces[0];
        Brep split = bf.Split(curves, tol);
        if (split != null)
        {
          foreach(BrepFace splitFace in split.Faces)
          {
            bb.Add(splitFace.DuplicateFace(false));
          }
        }
        output.AddRange(LowerBrep(bb, curve, tol));
      }
    }
    return output;
  }

  //Determine the intersection between the roofs
  public List<Curve> BrepsCurvesIntersection(List<Brep> breps, int index, double tol, bool parallel)
  {
    List<Curve> output = new List<Curve> ();
    if (parallel)
    {
      System.Threading.Tasks.Parallel.For(0, breps.Count,
        i => {
        if (i != index)
        {
          Curve[] intersectionCurves;
          Point3d[] intersectionPoints;
          if (Rhino.Geometry.Intersect.Intersection.BrepBrep(breps[i], breps[index], tol, out intersectionCurves, out intersectionPoints))
          {
            foreach (Curve curve in intersectionCurves)
            {
              output.Add(curve);
            }
          }
        }
        });
    }
      //Not parallel
    else
    {
      for (int i = 0; i < (breps.Count - 0); i++)
      {
        if (i != index)
        {
          Curve[] intersectionCurves;
          Point3d[] intersectionPoints;
          if (Rhino.Geometry.Intersect.Intersection.BrepBrep(breps[i], breps[index], tol, out intersectionCurves, out intersectionPoints))
          {
            foreach (Curve curve in intersectionCurves)
            {
              output.Add(curve);
            }
          }
        }
      }
    }
    return output;
  }
  //Search for the lower breps, if brep touch the contour of the roof (roofCurve)
  public List<Brep> LowerBrep(List<Brep> breps, Curve roofCurve, double tol)
  {
    List<Brep> output = new List<Brep>();
    int index = -1;
    if (breps.Count == 1)
    {
      output.Add(breps[0]);
    }
    else
    {
      for (int i = 0; i < breps.Count; i++)
      {
        Curve[] overlapCurves;
        Point3d[] intersectionPoints;
        bool test = Rhino.Geometry.Intersect.Intersection.CurveBrep(roofCurve, breps[i], tol, out overlapCurves, out  intersectionPoints);

        if (test)
        {
          //If the overlap is on the curve it is the part we want
          if (overlapCurves.Length >= 1)
          {
            output.Add(breps[i]);
          }          
          if (intersectionPoints.Length >= 1)
          {
            index = i;
          }
        }
      }
      //If there is just a point of contact, it must be a Valley
      if ((output.Count == 0) && (index != -1))
      {
        output.Add(breps[index]);
      }
    }
    return output;
  }
  //Calculate the surface of a flat closed polygon on XY plane
  //The polygon could be on whatever height (allowed by substraction of polyline[0])
  // Positive if CounterClockwise
  // Negative if Clockwise
  public double SurfaceOnXYplane(Polyline polyline)
  {
    Vector3d sum = Vector3d.Zero;
    for (int i = 0; i < (polyline.Count - 1); i++)
    {
      Vector3d cross = Vector3d.CrossProduct((Vector3d) (polyline[i] - polyline[0]), (Vector3d) (polyline[i + 1] - polyline[0]));
      sum = sum + cross;
    }
    return sum.Z;
  }
# ---------- end c_script ----------
debrep = DeconstructBrep(Brep=c_script.roofs)  # -> Faces, Edges, Vertices; disabled
explode = Explode(Curve=debrep.Edges, Recursive=True)  # -> Segments, Vertices; disabled
trim = TrimTree(Tree=explode.Segments, Depth=2)  # disabled
walls_boundaries_6 = Curve(region_difference)  # disabled
end = EndPoints(Curve=trim)  # -> Start, End; disabled
deconstruct_brep_3 = DeconstructBrep(Brep=walls_boundaries_6)  # -> Faces, Edges, Vertices; disabled
crv_cp = CurveClosestPoint(Point=end.End, Curve=graft)  # -> Point, Parameter, Distance; disabled
crv_cp_2 = CurveClosestPoint(Point=end.Start, Curve=graft)  # -> Point, Parameter, Distance; disabled
length_3 = Length(Curve=deconstruct_brep_3.Edges)  # disabled
min_2 = Minimum(A=crv_cp_2.Distance, B=crv_cp.Distance)  # disabled
test_points_3 = Point(simplify(flatten(point_7)))  # disabled
living_centroid = Point(area_10.Centroid)  # disabled
larger = LargerThan(FirstNumber=min_2, SecondNumber=multiplication_5)  # -> LargerThan, OrEqualTo; disabled
sort_list_2 = SortList(Keys=reverse(length_3), ValuesValuesA=deconstruct_brep_3.Edges)  # -> Keys, ValuesValuesA; disabled
dispatch_16 = Dispatch(List=trim, DispatchPattern=larger.LargerThan)  # -> ListA, ListB; disabled
all_grid_points = Point(simplify(flatten([dispatch_14.ListA, dispatch_14.ListB])))  # disabled
crv_2 = Curve(dispatch_16.ListA)  # disabled
bathroomcentroids = Data(flatten(area_23.Centroid))  # disabled
living_centroid_2 = Point(area_10.Centroid)  # disabled
project = Project(Geometry=crv_2, Plane=PlaneXY(0, 0, 0))  # -> Geometry, Transform; disabled
door_centroids = Point(area_22.Centroid)  # disabled
list_item_6 = ListItem(List=sort_list_2.ValuesValuesA, Index=0, Wrap=True)  # disabled
data_14 = Point(all_grid_points)  # disabled
distance_4 = Distance(PointA=living_centroid_2, PointB=flatten(bathroomcentroids))  # disabled
panel_28 = Panel("5")  # disabled
kitchen_centroid = Point(area_24.Centroid)  # disabled
end_2 = EndPoints(Curve=project.Geometry)  # -> Start, End; disabled
wall_segments = Curve(list_item_6)  # disabled
unit_x_4 = UnitX(Factor=panel_28)  # disabled
all_zone_boundaries = Curve([corridor_boundary_2, bedrooms_boundary_2, explode_tree_3.Branch0, dining_boundary_2, bath_boundary_2, other_boundary_2, living_boundary_2])  # disabled
list_length_6 = ListLength(List=door_centroids)  # disabled
ln_9 = Line(StartPoint=end_2.Start, EndPoint=end_2.End)  # disabled
dupln = RemoveDuplicateLines(Lines=ln_9, Tolerance=0.01)  # disabled
sort_list_3 = SortList(Keys=distance_4, ValuesValuesA=bathroomcentroids)  # -> Keys, ValuesValuesA; disabled
closest_points = ClosestPoints(Point=data_14, Cloud=door_centroids, Count=list_length_6)  # -> ClosestPoint, CPIndex, Distance; disabled
move_20 = Move(Geometry=data_14, Motion=unit_x_4)  # -> Geometry, Transform; disabled
join = JoinCurves(Curves=dupln, Preserve=False)  # disabled
all_zone_boundaries_2 = Curve([corridor_boundary_2, bedrooms_boundary_2, explode_tree_3.Branch0, dining_boundary_2, bath_boundary_2, other_boundary_2, living_boundary_2])  # disabled
length_4 = Length(Curve=wall_segments)  # disabled
simplify_2 = SimplifyCurve(Curve=join, Tolerance=expr("x/100", multiplication_3), AngleTolerance=rad)  # -> Curve, Simplified; disabled
first_last = FirstLast(List=sort_list_3.ValuesValuesA)  # -> FirstValue, LastValue; disabled
length_5 = Length(Curve=all_zone_boundaries)  # disabled
line_3 = Line(StartPoint=data_14, EndPoint=closest_points.ClosestPoint)  # disabled
line_4 = Line(StartPoint=data_14, EndPoint=move_20.Geometry)  # disabled
explode_2 = Explode(Curve=simplify_2.Curve, Recursive=True)  # -> Segments, Vertices; disabled
mass_addition_5 = MassAddition(Input=flatten(length_4))  # -> Result, PartialResults; disabled
trim_2 = TrimTree(Tree=explode_2.Segments, Depth=1)  # -> simplify(Tree); disabled
mass_addition_6 = MassAddition(Input=flatten(length_5))  # -> Result, PartialResults; disabled
area_25 = Area(Geometry=all_zone_boundaries_2)  # -> Area, Centroid; disabled
nearesttoilet = Data(first_last.FirstValue)  # disabled
angle = Angle(VectorA=line_4, VectorB=line_3)  # -> Angle, Reflex; disabled
length_6 = Length(Curve=line_3)  # -> flatten(Length); disabled
dupln_2 = RemoveDuplicateLines(Lines=trim_2, Tolerance=0.01)  # -> simplify(UniqueLines); disabled
panel_29 = Panel("1")  # disabled
total_wall_length = Data(mass_addition_5.Result)  # disabled
corridor_boundary_6 = Curve(corridor_boundary_2)  # disabled
distance_5 = Distance(PointA=data_14, PointB=kitchen_centroid)  # -> flatten(Distance); disabled
distance_6 = Distance(PointA=living_centroid_2, PointB=flatten(nearesttoilet))  # disabled
total_zone_length = Data(mass_addition_6.Result)  # disabled
degrees = Degrees(Radians=angle.Angle)  # -> flatten(Degrees); disabled
mass_addition_7 = MassAddition(Input=flatten(area_25.Area))  # -> Result, PartialResults; disabled
end_3 = EndPoints(Curve=dupln_2)  # -> Start, End; disabled
panel_30 = Panel("1")  # disabled
end_4 = EndPoints(Curve=dupln_2)  # -> Start, End; disabled
area_26 = Area(Geometry=corridor_boundary_6)  # -> Area, Centroid; disabled
panel_31 = Panel(total_zone_length)  # disabled
panel_32 = Panel(total_wall_length)  # disabled
cp_2 = ClosestPoint(Point=end_4.Start, Cloud=end_4.End)  # -> ClosestPoint, CPIndex, Distance; disabled
cp_3 = ClosestPoint(Point=end_3.End, Cloud=end_3.Start)  # -> ClosestPoint, CPIndex, Distance; disabled
average_2 = Average(Input=length_6)  # disabled
average_3 = Average(Input=distance_5)  # disabled
average_4 = Average(Input=degrees)  # disabled
livingarea = Data(area_10.Area)  # disabled
livingarea_2 = Data(area_10.Area)  # disabled
kitchenarea = Data(area_24.Area)  # disabled
livingarea_3 = Data(area_10.Area)  # disabled
larger_2 = LargerThan(FirstNumber=cp_2.Distance, SecondNumber=panel_30)  # -> LargerThan, OrEqualTo; disabled
larger_3 = LargerThan(FirstNumber=cp_3.Distance, SecondNumber=panel_30)  # -> LargerThan, OrEqualTo; disabled
division_3 = Division(A=livingarea_2, B=area_26.Area)  # disabled
division_4 = Division(A=livingarea, B=mass_addition_7.Result)  # disabled
division_5 = Division(A=livingarea_3, B=kitchenarea)  # disabled
dispatch_17 = Dispatch(List=dupln_2, DispatchPattern=larger_3.LargerThan)  # -> ListA, ListB; disabled
dispatch_18 = Dispatch(List=dupln_2, DispatchPattern=larger_2.LargerThan)  # -> ListA, ListB; disabled
division_6 = Division(A=total_zone_length, B=total_wall_length)  # disabled
line_5 = Line(dispatch_18.ListA)  # disabled
line_6 = Line(dispatch_17.ListA)  # disabled
x8_distance_to_nearest_toilet = Panel(distance_6)  # disabled
x7_living_area_kitchen_area = Panel(division_3)  # disabled
x6_living_area_floor_plan_area = Panel(division_4)  # disabled
x4_wall_length_zone_length = Panel(division_6)  # disabled
x5_living_area_kitchen_area = Panel(division_5)  # disabled
x2_average_angle_between_living_and_all = Panel(average_4)  # "X2 AVERAGE ANGLE BETWEEN LIVING AND ALL DOORS"; disabled
x3_distance_between_living_and_kitchen = Panel(average_3)  # disabled
x1_average_distance_between_living_and_a = Panel(average_2)  # "X1 AVERAGE DISTANCE BETWEEN LIVING AND ALL DOORS"; disabled
end_5 = EndPoints(Curve=line_5)  # -> Start, End; disabled
end_6 = EndPoints(Curve=line_6)  # -> Start, End; disabled
vec2pt = Vector2Pt(PointA=end_5.End, PointB=end_5.Start, Unitize=False)  # -> Vector, Length; disabled
vec2pt_2 = Vector2Pt(PointA=end_6.Start, PointB=end_6.End, Unitize=False)  # -> Vector, Length; disabled
line_7 = LineSDL(Start=end_5.Start, Direction=vec2pt.Vector, Length=multiplication_4)  # disabled
line_8 = LineSDL(Start=end_6.End, Direction=vec2pt_2.Vector, Length=multiplication_4)  # disabled
ccx = CurveCurve(CurveA=line_7, CurveB=graft)  # -> Points, ParamsA, ParamsB; disabled
ccx_2 = CurveCurve(CurveA=line_8, CurveB=graft)  # -> Points, ParamsA, ParamsB; disabled
x3 = DataRecorder(distance_5, DataLimit=-10, RecordData=False)  # disabled
x4 = DataRecorder(division_6, DataLimit=-10, RecordData=False)  # disabled
x5 = DataRecorder(division_5, DataLimit=-10, RecordData=False)  # disabled
x6 = DataRecorder(division_4, DataLimit=-10, RecordData=False)  # disabled
x7 = DataRecorder(division_3, DataLimit=-10, RecordData=False)  # disabled
x8 = DataRecorder(distance_6, DataLimit=-10, RecordData=False)  # disabled
x1 = DataRecorder(average_2, DataLimit=-10, RecordData=False)  # disabled
x2 = DataRecorder(average_4, DataLimit=-10, RecordData=False)  # disabled
shatter = Shatter(Curve=graft(line_8), Parameters=ccx_2.ParamsA)  # disabled
shatter_2 = Shatter(Curve=graft(line_7), Parameters=ccx.ParamsA)  # disabled
x8_2 = Panel(x8)  # disabled
x4_2 = Panel(x4)  # disabled
x7_2 = Panel(x7)  # disabled
x6_2 = Panel(x6)  # disabled
x3_2 = Panel(x3)  # disabled
x1_2 = Panel(x1)  # disabled
x2_2 = Panel(x2)  # disabled
x5_2 = Panel(x5)  # disabled
crv_3 = Curve([shatter_2, shatter])  # disabled
data_15 = Data(Tree({10;0}: [4.340130063, 12.11985703, 6.331854768, 5.792550997, 5.795460103, 5.761322748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], {10;1}: [3.853845511, 3.853845511, 9.55860587, 3.255433002, 6.930343022, 2.981760558]))  # disabled
data_16 = Data([3.5, 2, 2.5, 7.5, 5.5, 7, 6.5, 5.5, 7, 5.5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])  # disabled
data_17 = Data(Tree({10;0}: [2.869606563, 3.08906194, 3.925478728, 5.372096054, 5.376471983, 5.351479873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], {10;1}: [0.8864142434, 1.524789785, 1.96427333]))  # disabled
data_18 = Data([0.1601738444, 0.2787094831, 0.09408262928, 0.1480868009, 0.1275454493, 0.1249049381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])  # disabled
data_19 = Data(Tree({10;0}: [8.481645992, 7.458173648, 5.209491311, 3.808253563, 3.80384506, 3.797479106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], {10;1}: [7.20504638, 6.434010418, 8.23311603]))  # disabled
data_20 = Data(Tree({10;0}: [1.793050769, 3.530756013, 3.028644159, 2.055017149, 2.043586294, 2.034086842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], {10;1}: [4.562159018, 21.49758338, 2.903655513, 10.86981723, 3.329895101, 4.843173683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], {10;2}: [3.192274325, 1.663021841, 10.48621458, 1.340575625, 3.85245335, 6.491263981, 6.79659349, 8.261440301, 5.711024, 4.249986389, 1.219658136, 3.206070406, 1.207313491, 10.17385181, 10.47264734, 1.102868641, 4.48325735], {10;3}: [16.585568, 4.38504988, 12.11890227, 15.77694613, 3.213618878, 6.100006162], {10;4}: [26.51873409, 5.547130822, 3.310194315], {10;5}: [4.467635282]))  # disabled
data_21 = Data(Tree({10;0;0}: [7.820768267, 8.087228281, 6.666295053, 5.193029182, 5.207457755, 5.20376066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], {10;1;0}: [7.74699746, 8.898472678, 6.822030501]))  # disabled
data_22 = Data(Tree({10;0}: [0.246125482, 0.414920956, 0.3096744236, 0.3137052587, 0.2851877481, 0.2860952263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], {10;1}: [0.1112905578, 0.1133844525, 0.113770666]))  # disabled
data_23 = Data(Tree({10;0;0}: [143.6881512, 27.57805738, 111.5966314, 58.0008143, 61.74674263, 63.10241428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], {10;1;0}: [57.8413256, 43.89434758, 124.5710985]))  # disabled
curvepoint = PointOnCurve(crv_3, parameter=0.5)  # disabled
explode_tree_4 = ExplodeTree(Data=data_21)  # -> Branch0, Branch1; disabled
explode_tree_5 = ExplodeTree(Data=data_23)  # -> Branch0, Branch1; disabled
explode_tree_6 = ExplodeTree(Data=data_15)  # -> Branch0, Branch1; disabled
explode_tree_7 = ExplodeTree(Data=data_19)  # -> Branch0, Branch1; disabled
explode_tree_8 = ExplodeTree(Data=data_18)  # -> Branch0, Branch1; disabled
explode_tree_9 = ExplodeTree(Data=data_20)  # -> Branch0, Branch1, Branch2, Branch3, Branch4, Branch5; disabled
explode_tree_10 = ExplodeTree(Data=data_17)  # -> Branch0, Branch1; disabled
explode_tree_11 = ExplodeTree(Data=data_16)  # -> Branch0, Branch1; disabled
explode_tree_12 = ExplodeTree(Data=data_22)  # -> Branch0, Branch1; disabled
incurve = PointInCurve(Point=curvepoint, Curve=graft)  # -> Relationship, Point; disabled
panel_33 = Panel("2")  # disabled
equals = Equality(FirstNumber=incurve.Relationship, SecondNumber=panel_33)  # -> Equality, Inequality; disabled
reverse_list_8 = ReverseList(List=explode_tree_11.Branch0)  # disabled
reverse_list_9 = ReverseList(List=explode_tree_6.Branch0)  # disabled
reverse_list_10 = ReverseList(List=explode_tree_8.Branch0)  # disabled
reverse_list_11 = ReverseList(List=explode_tree_9.Branch0)  # disabled
reverse_list_12 = ReverseList(List=explode_tree_12.Branch0)  # disabled
reverse_list_13 = ReverseList(List=explode_tree_7.Branch0)  # disabled
reverse_list_14 = ReverseList(List=explode_tree_10.Branch0)  # disabled
reverse_list_15 = ReverseList(List=explode_tree_4.Branch0)  # disabled
reverse_list_16 = ReverseList(List=explode_tree_5.Branch0)  # disabled
dispatch_19 = Dispatch(List=crv_3, DispatchPattern=equals.Equality)  # -> ListA, ListB; disabled
swatch_2 = ColourSwatch(SwatchColor=RGB(255, 239, 255))  # disabled
x9 = Panel(reverse_list_8)  # disabled
x7_3 = Panel(reverse_list_11)  # disabled
x6_3 = Panel(reverse_list_12)  # disabled
x4_3 = Panel(reverse_list_10)  # disabled
x1_3 = Panel(reverse_list_15)  # disabled
x3_3 = Panel(reverse_list_13)  # disabled
x8_3 = Panel(reverse_list_9)  # disabled
x2_3 = Panel(reverse_list_16)  # disabled
x5_3 = Panel(reverse_list_14)  # disabled
crv_4 = Curve([join, dispatch_19.ListA])  # disabled
previewlw_2 = CustomPreviewLineweights(Geometry=crv_4, Shader=swatch_2, Thickness=3, Absolute=False)  # disabled

boundary_surfaces_7 = BoundarySurfaces(Edges=explode_tree_2.Branch1)  # disabled
mesh_brep = MeshBrep(
    Brep=boundary_surfaces_7,
    Settings={GridMaxCount=0, GridMinCount=16, JaggedSeams=False, MaxEdgeLength=0, MinEdgeLength=0.0001, MinTolerance=0, Refine=True, RefineAngle=0, RelativeTolerance=0.65, SimplePlanes=True, Tolerance=0})  # disabled
unit_x_5 = UnitX(Factor=1)  # disabled
unit_y_2 = UnitY(Factor=1)  # disabled
mesh_3 = Mesh(mesh_brep)  # disabled
contour = Contour(Shape=mesh_3, Point=Point(0, 0, 0), Direction=list_item_4, Distance=number_slider_12)  # disabled
polygon_center = PolygonCenter(Polyline=contour)  # -> CenterV, CenterE, CenterA; disabled
number_slider_17 = Slider(0.12, range=0..1)  # disabled
point_10 = Point(flatten(polygon_center.CenterV))  # disabled
cullpt = CullDuplicates(Points=point_10, Tolerance=number_slider_17, CullMode=1)  # -> Points, Indices, Valence; disabled
list_item_7 = ListItem(List=cullpt.Points, Index=0, Wrap=True)  # disabled
pt_14 = Point(cullpt.Points)  # disabled
pt_15 = Point(list_item_7)  # disabled
vb = VBScript(Start=pt_15, Points=pt_14)  # -> out, List; inputs Start: Point3d, Points: list of Point3d; disabled
# ---------- vb: VB ----------
    Dim ps As New Point3dList(Points)
    Dim polyline As New Polyline()

    Do
      If (ps.Count = 0) Then Exit Do

      Dim idx As Int32 = ps.ClosestIndex(Start)
      polyline.Add(ps(idx))
      Start = ps(idx)
      ps.RemoveAt(idx)
    Loop

    List = polyline
# ---------- end vb ----------
explode_3 = Explode(Curve=vb.List, Recursive=True)  # -> Segments, Vertices; disabled
number_slider_18 = Slider(0.3, range=0.05..3)  # disabled
list_length_7 = ListLength(List=explode_3.Vertices)  # disabled
panel_34 = Panel("0")  # disabled
panel_35 = Panel("1")  # disabled
subtraction_5 = Subtraction(A=list_length_7, B=panel_35)  # disabled
merge = Merge(Data1=panel_34, Data2=list_length_7, Data3=subtraction_5)  # -> flatten(Result); disabled
point_list = PointList(Points=explode_3.Vertices, Size=number_slider_18)  # disabled
cull_index = CullIndex(List=explode_3.Vertices, Indices=flatten(merge), Wrap=True)  # disabled
polyline_3 = PolyLine(Vertices=cull_index, Closed=False)  # disabled
explode_4 = Explode(Curve=polyline_3, Recursive=True)  # -> Segments, Vertices; disabled
unit_x_6 = UnitX(Factor=1)  # disabled
angle_2 = Angle(VectorA=explode_4.Segments, VectorB=unit_vector_5)  # -> Angle, Reflex; disabled
degrees_2 = Degrees(Radians=angle_2.Angle)  # disabled
panel_36 = Panel(degrees_2)  # disabled
panel_37 = Panel("90")  # disabled
round_to_factor = RoundToFactor(NumberX=degrees_2, Factor=panel_37, RoundType=0)  # -> Rounded, Difference, MultiplierR, MultiplierX; disabled
panel_38 = Panel(round_to_factor.Rounded)  # disabled
delete_consecutive = DeleteConsecutive(Set=panel_38, Wrap=False)  # -> Set, Count; disabled
list_length_8 = ListLength(List=delete_consecutive.Set)  # disabled
panel_39 = Panel("0")  # disabled
subtraction_6 = Subtraction(A=list_length_8, B=panel_39)  # disabled

boundary_surfaces_8 = BoundarySurfaces(Edges=explode_tree_2.Branch1)  # disabled
mesh_brep_2 = MeshBrep(
    Brep=boundary_surfaces_8,
    Settings={GridMaxCount=0, GridMinCount=16, JaggedSeams=False, MaxEdgeLength=0, MinEdgeLength=0.0001, MinTolerance=0, Refine=True, RefineAngle=0, RelativeTolerance=0.65, SimplePlanes=True, Tolerance=0})  # disabled
unit_y_3 = UnitY(Factor=1)  # disabled
unit_x_7 = UnitX(Factor=1)  # disabled
mesh_4 = Mesh(mesh_brep_2)  # disabled
contour_2 = Contour(Shape=mesh_4, Point=Point(0, 0, 0), Direction=list_item_5, Distance=division_2)  # disabled
contour_3 = Contour(Shape=mesh_4, Point=Point(0, 0, 0), Direction=list_item_4, Distance=division_2)  # disabled
polygon_center_2 = PolygonCenter(Polyline=contour_2)  # -> CenterV, CenterE, CenterA; disabled
polygon_center_3 = PolygonCenter(Polyline=contour_3)  # -> CenterV, CenterE, CenterA; disabled
number_slider_19 = Slider(0.15, range=0..1)  # disabled
number_slider_20 = Slider(0.12, range=0..1)  # disabled
point_11 = Point(flatten(polygon_center_2.CenterV))  # disabled
point_12 = Point(flatten(polygon_center_3.CenterV))  # disabled
cullpt_2 = CullDuplicates(Points=point_11, Tolerance=number_slider_19, CullMode=1)  # -> Points, Indices, Valence; disabled
cullpt_3 = CullDuplicates(Points=point_12, Tolerance=number_slider_20, CullMode=1)  # -> Points, Indices, Valence; disabled
list_item_8 = ListItem(List=cullpt_2.Points, Index=0, Wrap=True)  # disabled
list_item_9 = ListItem(List=cullpt_3.Points, Index=0, Wrap=True)  # disabled
pt_16 = Point(cullpt_2.Points)  # disabled
pt_17 = Point(list_item_8)  # disabled
pt_18 = Point(cullpt_3.Points)  # disabled
pt_19 = Point(list_item_9)  # disabled
vb_2 = VBScript(Start=pt_17, Points=pt_16)  # -> out, List; inputs Start: Point3d, Points: list of Point3d; disabled; same code as vb
vb_3 = VBScript(Start=pt_19, Points=pt_18)  # -> out, List; inputs Start: Point3d, Points: list of Point3d; disabled; same code as vb
explode_5 = Explode(Curve=vb_2.List, Recursive=True)  # -> Segments, Vertices; disabled
explode_6 = Explode(Curve=vb_3.List, Recursive=True)  # -> Segments, Vertices; disabled
number_slider_21 = Slider(0.3, range=0.05..3)  # disabled
list_length_9 = ListLength(List=explode_5.Vertices)  # disabled
panel_40 = Panel("1")  # disabled
panel_41 = Panel("1")  # disabled
number_slider_22 = Slider(0.3, range=0.05..3)  # disabled
list_length_10 = ListLength(List=explode_6.Vertices)  # disabled
subtraction_7 = Subtraction(A=list_length_9, B=panel_41)  # disabled
subtraction_8 = Subtraction(A=list_length_10, B=panel_40)  # disabled
panel_42 = Panel("0")  # disabled
panel_43 = Panel("0")  # disabled
point_list_2 = PointList(Points=explode_5.Vertices, Size=number_slider_21)  # disabled
merge_2 = Merge(Data1=panel_42, Data2=list_length_9, Data3=subtraction_7)  # -> flatten(Result); disabled
merge_3 = Merge(Data1=panel_43, Data2=list_length_10, Data3=subtraction_8)  # -> flatten(Result); disabled
point_list_3 = PointList(Points=explode_6.Vertices, Size=number_slider_22)  # disabled
cull_index_2 = CullIndex(List=explode_5.Vertices, Indices=flatten(merge_2), Wrap=True)  # disabled
cull_index_3 = CullIndex(List=explode_6.Vertices, Indices=flatten(merge_3), Wrap=True)  # disabled
polyline_4 = PolyLine(Vertices=cull_index_2, Closed=False)  # disabled
polyline_5 = PolyLine(Vertices=cull_index_3, Closed=False)  # disabled
explode_7 = Explode(Curve=polyline_4, Recursive=True)  # -> Segments, Vertices; disabled
explode_8 = Explode(Curve=polyline_5, Recursive=True)  # -> Segments, Vertices; disabled
unit_vector_6 = UnitVector(Vector=list_item_4)  # disabled
unit_vector_7 = UnitVector(Vector=list_item_4)  # disabled
unit_x_8 = UnitX(Factor=1)  # disabled
unit_x_9 = UnitX(Factor=1)  # disabled
angle_3 = Angle(VectorA=explode_7.Segments, VectorB=unit_vector_6)  # -> Angle, Reflex; disabled
angle_4 = Angle(VectorA=explode_8.Segments, VectorB=unit_vector_7)  # -> Angle, Reflex; disabled
degrees_3 = Degrees(Radians=angle_3.Angle)  # disabled
degrees_4 = Degrees(Radians=angle_4.Angle)  # disabled
panel_44 = Panel(degrees_3)  # disabled
panel_45 = Panel(degrees_4)  # disabled
panel_46 = Panel("90")  # disabled
panel_47 = Panel("90")  # disabled
round_to_factor_2 = RoundToFactor(NumberX=degrees_3, Factor=panel_46, RoundType=1)  # -> Rounded, Difference, MultiplierR, MultiplierX; disabled
round_to_factor_3 = RoundToFactor(NumberX=degrees_4, Factor=panel_47, RoundType=0)  # -> Rounded, Difference, MultiplierR, MultiplierX; disabled
panel_48 = Panel(round_to_factor_2.Rounded)  # disabled
panel_49 = Panel(round_to_factor_3.Rounded)  # disabled
delete_consecutive_2 = DeleteConsecutive(Set=panel_48, Wrap=False)  # -> Set, Count; disabled
delete_consecutive_3 = DeleteConsecutive(Set=panel_49, Wrap=False)  # -> Set, Count; disabled
list_length_11 = ListLength(List=delete_consecutive_2.Set)  # disabled
list_length_12 = ListLength(List=delete_consecutive_3.Set)  # disabled
subtraction_9 = Subtraction(A=list_length_11, B=panel_39)  # disabled
subtraction_10 = Subtraction(A=list_length_12, B=panel_39)  # disabled
x8_corridor_moments_of_decision = Panel(subtraction_10)  # disabled
x8_corridor_moments_of_decision_2 = Panel(subtraction_9)  # disabled
merge_4 = Merge(Data1=subtraction_10, Data2=subtraction_9)  # disabled
average_5 = Average(Input=merge_4)  # disabled
x8_corridor_moments_of_decision_3 = Panel(average_5)  # disabled

boundary_surfaces_9 = BoundarySurfaces(Edges=explode_tree_2.Branch2)  # disabled
mesh_brep_3 = MeshBrep(
    Brep=boundary_surfaces_9,
    Settings={GridMaxCount=0, GridMinCount=16, JaggedSeams=False, MaxEdgeLength=0, MinEdgeLength=0.0001, MinTolerance=0, Refine=True, RefineAngle=0, RelativeTolerance=0.65, SimplePlanes=True, Tolerance=0})  # disabled
unit_x_10 = UnitX(Factor=1)  # disabled
unit_y_4 = UnitY(Factor=1)  # disabled
mesh_5 = Mesh(mesh_brep_3)  # disabled
contour_4 = Contour(Shape=mesh_5, Point=Point(0, 0, 0), Direction=list_item_4, Distance=number_slider_12)  # disabled
polygon_center_4 = PolygonCenter(Polyline=contour_4)  # -> CenterV, CenterE, CenterA; disabled
number_slider_23 = Slider(0.12, range=0..1)  # disabled
point_13 = Point(flatten(polygon_center_4.CenterV))  # disabled
cullpt_4 = CullDuplicates(Points=point_13, Tolerance=number_slider_23, CullMode=1)  # -> Points, Indices, Valence; disabled
list_item_10 = ListItem(List=cullpt_4.Points, Index=0, Wrap=True)  # disabled
pt_20 = Point(cullpt_4.Points)  # disabled
pt_21 = Point(list_item_10)  # disabled
vb_4 = VBScript(Start=pt_21, Points=pt_20)  # -> out, List; inputs Start: Point3d, Points: list of Point3d; disabled; same code as vb
explode_9 = Explode(Curve=vb_4.List, Recursive=True)  # -> Segments, Vertices; disabled
number_slider_24 = Slider(0.3, range=0.05..3)  # disabled
list_length_13 = ListLength(List=explode_9.Vertices)  # disabled
panel_50 = Panel("0")  # disabled
panel_51 = Panel("1")  # disabled
subtraction_11 = Subtraction(A=list_length_13, B=panel_51)  # disabled
merge_5 = Merge(Data1=panel_50, Data2=list_length_13, Data3=subtraction_11)  # -> flatten(Result); disabled
point_list_4 = PointList(Points=explode_9.Vertices, Size=number_slider_24)  # disabled
cull_index_4 = CullIndex(List=explode_9.Vertices, Indices=flatten(merge_5), Wrap=True)  # disabled
polyline_6 = PolyLine(Vertices=cull_index_4, Closed=False)  # disabled
explode_10 = Explode(Curve=polyline_6, Recursive=True)  # -> Segments, Vertices; disabled
unit_x_11 = UnitX(Factor=1)  # disabled
angle_5 = Angle(VectorA=explode_10.Segments, VectorB=unit_vector_3)  # -> Angle, Reflex; disabled
degrees_5 = Degrees(Radians=angle_5.Angle)  # disabled
panel_52 = Panel(degrees_5)  # disabled
panel_53 = Panel("90")  # disabled
round_to_factor_4 = RoundToFactor(NumberX=degrees_5, Factor=panel_53, RoundType=0)  # -> Rounded, Difference, MultiplierR, MultiplierX; disabled
panel_54 = Panel(round_to_factor_4.Rounded)  # disabled
delete_consecutive_4 = DeleteConsecutive(Set=panel_54, Wrap=False)  # -> Set, Count; disabled
list_length_14 = ListLength(List=delete_consecutive_4.Set)  # disabled
subtraction_12 = Subtraction(A=list_length_14, B=panel_39)  # disabled

boundary_surfaces_10 = BoundarySurfaces(Edges=explode_tree_2.Branch0)  # disabled
mesh_brep_4 = MeshBrep(
    Brep=boundary_surfaces_10,
    Settings={GridMaxCount=0, GridMinCount=16, JaggedSeams=False, MaxEdgeLength=0, MinEdgeLength=0.0001, MinTolerance=0, Refine=True, RefineAngle=0, RelativeTolerance=0.65, SimplePlanes=True, Tolerance=0})  # disabled
unit_y_5 = UnitY(Factor=1)  # disabled
unit_x_12 = UnitX(Factor=1)  # disabled
mesh_6 = Mesh(mesh_brep_4)  # disabled
contour_5 = Contour(Shape=mesh_6, Point=Point(0, 0, 0), Direction=list_item_5, Distance=division_2)  # disabled
polygon_center_5 = PolygonCenter(Polyline=contour_5)  # -> CenterV, CenterE, CenterA; disabled
point_14 = Point(flatten(polygon_center_5.CenterV))  # disabled
cullpt_5 = CullDuplicates(Points=point_14, Tolerance=number_slider, CullMode=1)  # -> Points, Indices, Valence; disabled
list_item_11 = ListItem(List=cullpt_5.Points, Index=0, Wrap=True)  # disabled
pt_22 = Point(cullpt_5.Points)  # disabled
pt_23 = Point(list_item_11)  # disabled
vb_5 = VBScript(Start=pt_23, Points=pt_22)  # -> out, List; inputs Start: Point3d, Points: list of Point3d; disabled; same code as vb
explode_11 = Explode(Curve=vb_5.List, Recursive=True)  # -> Segments, Vertices; disabled
number_slider_25 = Slider(0.3, range=0.05..3)  # disabled
list_length_15 = ListLength(List=explode_11.Vertices)  # disabled
panel_55 = Panel("1")  # disabled
subtraction_13 = Subtraction(A=list_length_15, B=panel_55)  # disabled
panel_56 = Panel("0")  # disabled
point_list_5 = PointList(Points=explode_11.Vertices, Size=number_slider_25)  # disabled
merge_6 = Merge(Data1=panel_56, Data2=list_length_15, Data3=subtraction_13)  # -> flatten(Result); disabled
cull_index_5 = CullIndex(List=explode_11.Vertices, Indices=flatten(merge_6), Wrap=True)  # disabled
polyline_7 = PolyLine(Vertices=cull_index_5, Closed=False)  # disabled
explode_12 = Explode(Curve=polyline_7, Recursive=True)  # -> Segments, Vertices; disabled
unit_x_13 = UnitX(Factor=1)  # disabled
angle_6 = Angle(VectorA=explode_12.Segments, VectorB=unit_vector)  # -> Angle, Reflex; disabled
degrees_6 = Degrees(Radians=angle_6.Angle)  # disabled
panel_57 = Panel(degrees_6)  # disabled
panel_58 = Panel("90")  # disabled
round_to_factor_5 = RoundToFactor(NumberX=degrees_6, Factor=panel_58, RoundType=1)  # -> Rounded, Difference, MultiplierR, MultiplierX; disabled
panel_59 = Panel(round_to_factor_5.Rounded)  # disabled
delete_consecutive_5 = DeleteConsecutive(Set=panel_59, Wrap=False)  # -> Set, Count; disabled
list_length_16 = ListLength(List=delete_consecutive_5.Set)  # disabled
subtraction_14 = Subtraction(A=list_length_16, B=panel_39)  # disabled

boundary_surfaces_11 = BoundarySurfaces(Edges=explode_tree_2.Branch3)  # disabled
mesh_brep_5 = MeshBrep(
    Brep=boundary_surfaces_11,
    Settings={GridMaxCount=0, GridMinCount=16, JaggedSeams=False, MaxEdgeLength=0, MinEdgeLength=0.0001, MinTolerance=0, Refine=True, RefineAngle=0, RelativeTolerance=0.65, SimplePlanes=True, Tolerance=0})  # disabled
unit_x_14 = UnitX(Factor=1)  # disabled
unit_y_6 = UnitY(Factor=1)  # disabled
mesh_7 = Mesh(mesh_brep_5)  # disabled
contour_6 = Contour(Shape=mesh_7, Point=Point(0, 0, 0), Direction=list_item_4, Distance=number_slider_12)  # disabled
polygon_center_6 = PolygonCenter(Polyline=contour_6)  # -> CenterV, CenterE, CenterA; disabled
number_slider_26 = Slider(0.12, range=0..1)  # disabled
point_15 = Point(flatten(polygon_center_6.CenterV))  # disabled
cullpt_6 = CullDuplicates(Points=point_15, Tolerance=number_slider_26, CullMode=1)  # -> Points, Indices, Valence; disabled
list_item_12 = ListItem(List=cullpt_6.Points, Index=0, Wrap=True)  # disabled
pt_24 = Point(cullpt_6.Points)  # disabled
pt_25 = Point(list_item_12)  # disabled
vb_6 = VBScript(Start=pt_25, Points=pt_24)  # -> out, List; inputs Start: Point3d, Points: list of Point3d; disabled; same code as vb
explode_13 = Explode(Curve=vb_6.List, Recursive=True)  # -> Segments, Vertices; disabled
number_slider_27 = Slider(0.3, range=0.05..3)  # disabled
list_length_17 = ListLength(List=explode_13.Vertices)  # disabled
panel_60 = Panel("0")  # disabled
panel_61 = Panel("1")  # disabled
subtraction_15 = Subtraction(A=list_length_17, B=panel_61)  # disabled
merge_7 = Merge(Data1=panel_60, Data2=list_length_17, Data3=subtraction_15)  # -> flatten(Result); disabled
point_list_6 = PointList(Points=explode_13.Vertices, Size=number_slider_27)  # disabled
cull_index_6 = CullIndex(List=explode_13.Vertices, Indices=flatten(merge_7), Wrap=True)  # disabled
polyline_8 = PolyLine(Vertices=cull_index_6, Closed=False)  # disabled
explode_14 = Explode(Curve=polyline_8, Recursive=True)  # -> Segments, Vertices; disabled
unit_x_15 = UnitX(Factor=1)  # disabled
angle_7 = Angle(VectorA=explode_14.Segments, VectorB=unit_vector_4)  # -> Angle, Reflex; disabled
degrees_7 = Degrees(Radians=angle_7.Angle)  # disabled
panel_62 = Panel(degrees_7)  # disabled
panel_63 = Panel("90")  # disabled
round_to_factor_6 = RoundToFactor(NumberX=degrees_7, Factor=panel_63, RoundType=0)  # -> Rounded, Difference, MultiplierR, MultiplierX; disabled
panel_64 = Panel(round_to_factor_6.Rounded)  # disabled
delete_consecutive_6 = DeleteConsecutive(Set=panel_64, Wrap=False)  # -> Set, Count; disabled
list_length_18 = ListLength(List=delete_consecutive_6.Set)  # disabled
subtraction_16 = Subtraction(A=list_length_18, B=panel_39)  # disabled

# ---- group: Extract Tips, Get Path
prune = PruneTree(Minimum=0, Maximum=1)  # disabled
tstat = TreeStatistics(Tree=simplify(prune))  # -> Paths, Length, Count; disabled
dpath = DeconstructPath(Branch=tstat.Paths)  # -> flatten(Indices); disabled
item_5 = ListItem(List=cullpt_5.Points, Index=dpath, Wrap=True)  # disabled
pdecon_2 = Deconstruct(Point=item_5)  # -> XComponent, YComponent, ZComponent; disabled
sort = SortList(Keys=pdecon_2.XComponent, ValuesA=item_5)  # -> Keys, ValuesA; disabled
panel_65 = Panel("0")  # disabled
item_6 = ListItem(List=sort.ValuesA, Index=panel_65, Wrap=True)  # -> graft(Item); disabled
cull_i_2 = CullIndex(List=sort.ValuesA, Indices=panel_65, Wrap=True)  # disabled
path_lines = Line(StartPoint=cull_i_2, EndPoint=item_6)  # disabled

# ---- group: Output (Shortest Walk)
shortwalk = ShortestWalk(Curves=prox_network, WantedPath=path_lines)  # -> ShortestWalk, Succession, Direction, Length; disabled

# ---- group: Splitting at intersections
len = Length(Curve=shortwalk.ShortestWalk)  # disabled
sort_2 = SortList(Keys=len, ValuesA=shortwalk.ShortestWalk)  # -> Keys, reverse(ValuesA); disabled
panel_66 = Panel("0")  # disabled
cull_i_3 = CullIndex(List=sort_2.ValuesA, Indices=panel_66, Wrap=True)  # disabled
item_7 = ListItem(List=sort_2.ValuesA, Index=panel_66, Wrap=True)  # disabled
ccx_3 = CurveCurve(CurveA=item_7, CurveB=cull_i_3)  # -> Points, ParamsA, ParamsB; disabled
item_8 = ListItem(List=ccx_3.ParamsB, Index=0, Wrap=True)  # disabled
shatter_3 = Shatter(Curve=graft(cull_i_3), Parameters=item_8)  # disabled
item_9 = ListItem(List=shatter_3, Index=0, Wrap=True)  # -> flatten(Item); disabled

# ----
contour_7 = Contour(Shape=mesh_6, Point=Point(0, 0, 0), Direction=list_item_4, Distance=division_2)  # disabled
polygon_center_7 = PolygonCenter(Polyline=contour_7)  # -> CenterV, CenterE, CenterA; disabled
point_16 = Point(flatten(polygon_center_7.CenterV))  # disabled
cullpt_7 = CullDuplicates(Points=point_16, Tolerance=number_slider_15, CullMode=1)  # -> Points, Indices, Valence; disabled
list_item_13 = ListItem(List=cullpt_7.Points, Index=0, Wrap=True)  # disabled
pt_26 = Point(cullpt_7.Points)  # disabled
pt_27 = Point(list_item_13)  # disabled
vb_7 = VBScript(Start=pt_27, Points=pt_26)  # -> out, List; inputs Start: Point3d, Points: list of Point3d; disabled; same code as vb
explode_15 = Explode(Curve=vb_7.List, Recursive=True)  # -> Segments, Vertices; disabled
list_length_19 = ListLength(List=explode_15.Vertices)  # disabled
subtraction_17 = Subtraction(A=list_length_19, B=panel_25)  # disabled
merge_8 = Merge(Data1=panel_26, Data2=list_length_19, Data3=subtraction_17)  # -> flatten(Result); disabled
point_list_7 = PointList(Points=explode_15.Vertices, Size=number_slider_16)  # disabled
cull_index_7 = CullIndex(List=explode_15.Vertices, Indices=flatten(merge_8), Wrap=True)  # disabled
polyline_9 = PolyLine(Vertices=cull_index_7, Closed=False)  # disabled
explode_16 = Explode(Curve=polyline_9, Recursive=True)  # -> Segments, Vertices; disabled
angle_8 = Angle(VectorA=explode_16.Segments, VectorB=unit_vector_2)  # -> Angle, Reflex; disabled
degrees_8 = Degrees(Radians=angle_8.Angle)  # disabled
panel_67 = Panel(degrees_8)  # disabled
round_to_factor_7 = RoundToFactor(NumberX=degrees_8, Factor=panel_27, RoundType=0)  # -> Rounded, Difference, MultiplierR, MultiplierX; disabled
panel_68 = Panel(round_to_factor_7.Rounded)  # disabled
delete_consecutive_7 = DeleteConsecutive(Set=panel_68, Wrap=False)  # -> Set, Count; disabled
list_length_20 = ListLength(List=delete_consecutive_7.Set)  # disabled
subtraction_18 = Subtraction(A=list_length_20, B=panel_39)  # disabled
x8_corridor_moments_of_decision_4 = Panel(subtraction_16)  # disabled
x8_corridor_moments_of_decision_5 = Panel(subtraction_6)  # disabled
x8_corridor_moments_of_decision_6 = Panel(subtraction_18)  # disabled
x8_corridor_moments_of_decision_7 = Panel(subtraction_14)  # disabled
x8_corridor_moments_of_decision_8 = Panel(subtraction_12)  # disabled
merge_9 = Merge(Data1=subtraction_18, Data2=subtraction_14)  # disabled
average_6 = Average(Input=merge_9)  # disabled
final_curves = Merge(Data1=item_7, Data2=item_9)  # disabled
mass_addition_8 = MassAddition(Input=flatten([subtraction_12, subtraction_16, subtraction_6, subtraction_14]))  # -> Result, PartialResults; disabled
x8_corridor_moments_of_decision_9 = Panel(average_6)  # disabled
sort_list_4 = SortList(Keys=average_6)  # -> flatten(Keys), ValuesValuesA; disabled
x8_corridor_moments_of_decision_10 = Panel(sort_list_4.Keys)  # disabled
first_last_2 = FirstLast(List=sort_list_4.Keys)  # -> flatten(FirstValue), LastValue; disabled
expression_29 = Expression(x=first_last_2.FirstValue, w=panel_29, v=first_last_2.FirstValue, Expression="If(x=0, w,v)")  # disabled
x9_corridor_moments_of_decision = Panel(expression_29)  # disabled
x9_2 = DataRecorder(expression_29, DataLimit=-10, RecordData=False)  # disabled
x9_3 = Panel(x9_2)  # disabled

# ----
# --Inputs--
# 
# srf- a list of surfaces to consider for bouncing. Basically the output faces from an explode brep component.  There are currently issues with surfaces which are trimmed.
# 
# startPt- where the bounce solution eminates from.
# 
# startVec- the starting direction
# 
# intMaxBounces- the max number of bounces
# 
# unit- Unit value
# 
# coefList- A list of value for each plane
# 
# --Outputs--
# 
# reflectionPtList- a list of points in the order they reflect
# 
# reflectionPtCoefList- a list of value from each plane they hit
# Sound modelling using raytracing, Enable all cluster to activate the script
# INPUT....
# 
# 
# geometry of the space / ojects
# sound source: lounge centroid
# Show nb rebound :
# if true, show number of rebounds
# if false, show value calculated instead
# calculate value in each points
sound_intensity_dba = Slider(100, range=70..120)  # disabled
panel_69 = Panel(".35")  # disabled
geometry = Geometry([doors_boundaries, walls_boundaries])  # disabled
absorption_coefficient = Panel("0.15")  # disabled
walls_boundaries_7 = Curve(geometry)  # disabled
number_slider_28 = Slider(3.5, range=0..10)  # disabled
wall_obstacles_curves = Curve(walls_boundaries_7)  # disabled
Z = UnitZ(Factor=number_slider_28)  # disabled
extr = Extrude(Base=wall_obstacles_curves, Direction=Z)  # disabled
panel_70 = Panel("PARAMETERS")  # disabled
kitchencentroid = Data(area.Centroid)  # disabled
number_slider_29 = Slider(12, range=1..12)  # disabled
list_item_14 = ListItem(List=flatten(kitchencentroid), Index=0, Wrap=True)  # disabled
panel_71 = Panel("0 to 360")  # disabled
range_2 = Range(Domain=panel_71, Steps=number_slider_29)  # disabled
sddp = ShapeDiverDocumentPayload({AbsoluteTolerance=0, AngleTolerance=0, DistanceDisplayPrecision=0, GltfVersion="Gltf2", InputGroups="{}", OutputGroups="{}", RelativeTolerance=0, UnitSystem=0, VersionCreated="1.13.1.0", VersionSaved="1.13.1.0"})  # disabled
panel_72 = Panel("starting vectors")  # disabled
eval = Evaluate(F="x*2*π/360", x=orientationz)  # disabled
number_slider_30 = Slider(1904, range=0..10000)  # disabled
vb_8 = VBScript()  # -> out, coef; disabled
# ---------- vb_8: VB usings ----------
Imports System.IO
Imports System.Linq
Imports System.Data
Imports System.Drawing
Imports System.Reflection
Imports System.Windows.Forms
Imports System.Xml
Imports System.Xml.Linq
Imports Microsoft.VisualBasic
Imports System.Runtime.InteropServices

Imports Rhino.DocObjects
Imports Rhino.Collections
Imports GH_IO
Imports GH_IO.Serialization
# ---------- vb_8: VB ----------
    Dim units As Rhino.UnitSystem = RhinoDocument.ModelUnitSystem()
    Print(units)
    Dim unit_meter As New Rhino.UnitSystem
    unit_meter = UnitSystem.Meters
    Print(unit_meter)
    coef = RhinoMath.UnitScale(units, unit_meter)
    Print(coef)
    'coef = 1 / unit_meter.Scale(units)
# ---------- end vb_8 ----------
panel_73 = Panel("sound speed : 343m/s")  # disabled
panel_74 = Panel("0.343")  # disabled
multiplication_6 = Multiplication(A=panel_74, B=vb_8.coef)  # disabled
multiplication_7 = Multiplication(A=multiplication_6, B=nb_ms)  # disabled
number_slider_31 = Slider(100, range=0..100)  # disabled
X_17 = UnitX(Factor=-0.25)  # disabled
number_slider_32 = Slider(0.01, range=0.01..0.5)  # disabled
xy_plane_3 = XYPlane(Origin=Point(0, 0, 0))  # disabled
colour_swatch_2 = ColourSwatch(SwatchColor=RGBA(143, 94, 255, 234))  # disabled
unit_z_3 = UnitZ(Factor=1)  # disabled

buildingeometry = Geometry(extr)  # disabled
sound_source = Point(list_item_14)  # disabled

# ---- group: geomertry
merge_10 = Merge(Data1=flatten(buildingeometry))  # disabled

# ----
dom = Domain(DomainStart=expr("x*-1", angle_ouverture), DomainEnd=angle_ouverture)  # disabled
Z_2 = UnitZ(Factor=1)  # disabled
X_18 = UnitX(Factor=1)  # disabled
eval_2 = Evaluate(F="x*2*π/360", x=range_2)  # disabled
vrot = Rotate(Vector=X_18, Axis=Z_2, Angle=eval_2)  # disabled
range_3 = Range(Domain=dom, Steps=nb_ray)  # disabled
Y = UnitY(Factor=1)  # disabled
Z_3 = UnitZ(Factor=1)  # disabled
vrot_2 = Rotate(Vector=vrot, Axis=Y, Angle=eval, DataComparison="cross_reference")  # disabled
Y_2 = UnitY(Factor=1)  # disabled

mesh_8 = MeshBrep(
    Brep=merge_10,
    Settings={GridMaxCount=0, GridMinCount=16, JaggedSeams=False, MaxEdgeLength=0, MinEdgeLength=0.0001, MinTolerance=0, Refine=True, RefineAngle=0, RelativeTolerance=0.65, SimplePlanes=True, Tolerance=0})  # disabled
eval_3 = Evaluate(F="x*2*π/360", x=range_3)  # disabled
mjoin = MeshJoin(Meshes=mesh_8)  # disabled
eval_4 = Evaluate(F="x*2*π/360", x=range_3)  # disabled

vrot_3 = Rotate(Vector=vrot_2, Axis=Z_3, Angle=eval_3)  # disabled
vrot_4 = Rotate(Vector=vrot_3, Axis=Y_2, Angle=eval_4, DataComparison="cross_reference")  # disabled
dcon = DeleteConsecutive(Set=vrot_4, Wrap=False)  # -> Set, Count; disabled

# ---- group: see vectors
vdis = VectorDisplay(Anchor=sound_source, Vector=dcon.Set)  # disabled

# ----
amp = Amplitude(Vector=vrot_4, Amplitude=number_slider_30)  # disabled

# ---- group: NEW FROM LADYBUG
forwardraytracing = Ladybug_ForwardRaytracing(startPts=sound_source, startVectors=graft(amp), context=flatten(mjoin), numOfBounce=nb_bounces, lastBounceLen=4)  # -> rays; disabled; plug-in component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

# ----
divlength = DivideLength(Curve=forwardraytracing, Length=multiplication_7)  # -> Points, Tangents, Parameters; disabled
item_10 = ListItem(List=divlength.Parameters, Index=1, Wrap=False)  # disabled
shatter_4 = Shatter(Curve=forwardraytracing, Parameters=item_10)  # disabled
item_11 = ListItem(List=shatter_4, Index=0, Wrap=False)  # disabled
flatten = FlattenTree(Data=item_11, Path="{0}")  # disabled
divide = DivideCurve(Curve=flatten, Count=number_slider_31, Kinks=False)  # -> Points, Tangents, Parameters; disabled
item_12 = ListItem(List=divlength.Points, Index=1, Wrap=False)  # disabled
split = SplitList(List=divide.Points, Index=number_slider_3)  # -> ListA, ListB; disabled
data_24 = Data(split.ListA)  # disabled
crv_5 = Curve(forwardraytracing)  # disabled
flatten_2 = FlattenTree(Data=item_12, Path="{0}")  # disabled
move_21 = Move(Geometry=flatten_2, Motion=X_17)  # -> Geometry, Transform; disabled

disc = Discontinuity(Curve=item_11, Level=1)  # -> Points, Parameters; disabled
lng = ListLength(List=disc.Points)  # disabled
subtraction_19 = Subtraction(A=lng, B=2)  # disabled
filter = StreamFilter(Gate=show_nb_rebond, Stream0=subtraction_19)  # disabled
flatten_3 = FlattenTree(Data=filter, Path="{0}")  # disabled

# ---- group: see points bounce from 0-100% of path
curvepoint_2 = PointOnCurve(flatten, parameter=1)  # disabled

# ---- group: Path
pline_14 = PolyLine(Vertices=data_24, Closed=False)  # disabled

# ----
average_7 = Average(Input=flatten_3)  # disabled
round = Round(Number=average_7)  # -> Nearest, Floor, Ceiling; disabled
ave_no_of_bounces = Panel(round.Nearest)  # disabled
multiplication_8 = Multiplication(A=ave_no_of_bounces, B=absorption_coefficient)  # disabled
list_length_21 = ListLength(List=flatten(pline_14))  # disabled
division_7 = Division(A=list_length_21, B=2)  # disabled
split_list = SplitList(List=flatten(pline_14), Index=division_7)  # -> ListA, ListB; disabled
tag = TextTag(Location=move_21.Geometry, Text=flatten_3)  # disabled
curve_3 = Curve(split_list.ListA)  # disabled
list_item_15 = ListItem(List=curve_3, Index=3, Wrap=True)  # disabled
length_7 = Length(Curve=list_item_15)  # disabled
offset_curve = OffsetCurve(Curve=curve_3, Plane=xy_plane_3, Distance=number_slider_32, BothSides=0, Kinks=0, CapType=1)  # -> flatten(Offset); disabled
length_8 = Length(Curve=curve_3)  # disabled
average_8 = Average(Input=length_8)  # disabled
expression_30 = Expression(Lp_R1=sound_intensity_dba, R1=panel_69, R2=average_8, Expression="Lp_R1 - (20 * log10(R2 / R1))")  # disabled
dba = Panel(expression_30)  # disabled
expression_31 = Expression(x=expression_30, y=multiplication_8, Expression="x * (1 - 0.15)^y")  # disabled
ave_ray_length = Panel(average_8)  # disabled
ave_dba_received = Panel(expression_31)  # disabled
panel_75 = Panel(length_7)  # disabled
boundary_surfaces_12 = BoundarySurfaces(Edges=offset_curve)  # disabled
custom_preview_2 = CustomPreview(Geometry=boundary_surfaces_12, Material=colour_swatch_2)  # disabled
move_22 = Move(Geometry=curve_3, Motion=unit_z_3)  # -> Geometry, Transform; disabled
custom_preview_3 = CustomPreview(Geometry=move_22.Geometry, Material=colour_swatch_2)  # disabled

# ----
# DYNAMIC TARGET
# Note: Dynamic target is a circle with a diameter of 100 cm imported from Rhino which can be positioned anywhere on the plan by moving it in the viewport.
dynamictarget = Curve(<curve referenced from the Rhino model>)
boundary_surfaces_13 = BoundarySurfaces(Edges=dynamictarget)

# ----
# crosshair
crosshair = Curve([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])
bounding_rectangle_4 = BoundingRectangle(Geometry=crosshair, Plane=PlaneXY(0, 0, 0), Axis=0, Slide=0, Union=True)  # -> Bounding, DimensionX, DimensionY
area_27 = Area(Geometry=bounding_rectangle_4.Bounding)  # -> Area, Centroid
area_28 = Area(Geometry=dynamictarget)  # -> Area, Centroid
move_to_point_2 = MoveToPoint(Geometry=crosshair, PointA=area_27.Centroid, PointB=area_28.Centroid)  # -> Moved, Vector, Transform

crosshair_2 = Curve(move_to_point_2.Moved)
custom_preview_4 = CustomPreview(Geometry=[boundary_surfaces_13, crosshair_2], Material=ColourSwatch(SwatchColor=RGB(51, 150, 255)))

cluster_3 = Cluster(curve_a=isovistlines, curve_b=dynamictarget)
expression_32 = Expression(x=cluster_3, y=list_length, Expression="(x / y)")
of_test_points_with_clear_lines_of_sight_3 = Panel(expression_32)

curve_curve_4 = CurveCurve(CurveA=isovistlines_2, CurveB=flatten(dynamictarget))  # -> Points, ParamsA, ParamsB
kitchenboundary = Geometry(kitchenbounday)
isovistlines_3 = Geometry(isovistlines_2)
curve_curve_5 = CurveCurve(CurveA=isovistlines_2, CurveB=flatten(kitchenboundary))  # -> Points, ParamsA, ParamsB

door_visibility_radius_2 = Slider(0.412, range=0.1..1)
explode_tree_13 = ExplodeTree(Data=bath_boundary_3)  # -> Branch0, Branch1, Branch2, Branch3, Branch4, Branch5

doors_boundaries_3 = Curve(pline_9)
curve_curve_6 = CurveCurve(CurveA=explode_tree_13.Branch0, CurveB=doors_boundaries_3)  # -> Points, ParamsA, ParamsB
circle = Circle(Plane=curve_curve_6.Points, Radius=door_visibility_radius_2)
curve_curve_7 = CurveCurve(CurveA=circle, CurveB=doors_boundaries_3)  # -> flatten(Points), ParamsA, ParamsB
list_item_16 = ListItem(List=curve_curve_7.Points, Index=0, Wrap=True)
circle_2 = Circle(Plane=list_item_16, Radius=door_visibility_radius_2)
curve_curve_8 = CurveCurve(CurveA=circle_2, CurveB=flatten(isovistlines_2))  # -> Points, ParamsA, ParamsB
remove_duplicate_points_karamba3d = RemoveDuplicatePointsKaramba3D(Point=curve_curve_8.Points, LimitDistance=0.005)  # -> simplify(OutPoint), Info, Indexes
clean_tree_2 = CleanTree(RemoveNulls=True, RemoveInvalid=True, RemoveEmpty=True, Tree=remove_duplicate_points_karamba3d.OutPoint)
panel_76 = Panel(clean_tree_2)
tree_statistics = TreeStatistics(Tree=clean_tree_2)  # -> Paths, Length, Count
list_length_22 = ListLength(List=tree_statistics.Paths)
total_number_of_test_points_3 = Panel(totalnumberoftestpoints)
expression_33 = Expression(x=list_length_22, y=total_number_of_test_points_3, Expression="(x / y)")
of_test_points_with_clear_lines_of_sight_4 = Panel(expression_33)  # "% OF TEST POINTS WITH CLEAR LINES OF SIGHT TOILET 1"

doors_boundaries_4 = Curve(pline_9)
curve_curve_9 = CurveCurve(CurveA=explode_tree_13.Branch1, CurveB=doors_boundaries_4)  # -> Points, ParamsA, ParamsB
circle_3 = Circle(Plane=curve_curve_9.Points, Radius=door_visibility_radius_2)
curve_curve_10 = CurveCurve(CurveA=circle_3, CurveB=doors_boundaries_4)  # -> flatten(Points), ParamsA, ParamsB
list_item_17 = ListItem(List=curve_curve_10.Points, Index=0, Wrap=True)
circle_4 = Circle(Plane=list_item_17, Radius=door_visibility_radius_2)
curve_curve_11 = CurveCurve(CurveA=circle_4, CurveB=flatten(isovistlines_2))  # -> Points, ParamsA, ParamsB
remove_duplicate_points_karamba3d_2 = RemoveDuplicatePointsKaramba3D(Point=curve_curve_11.Points, LimitDistance=0.005)  # -> simplify(OutPoint), Info, Indexes
clean_tree_3 = CleanTree(RemoveNulls=True, RemoveInvalid=True, RemoveEmpty=True, Tree=remove_duplicate_points_karamba3d_2.OutPoint)
panel_77 = Panel(clean_tree_3)
tree_statistics_2 = TreeStatistics(Tree=clean_tree_3)  # -> Paths, Length, Count
list_length_23 = ListLength(List=tree_statistics_2.Paths)
total_number_of_test_points_4 = Panel(totalnumberoftestpoints)
expression_34 = Expression(x=list_length_23, y=total_number_of_test_points_4, Expression="(x / y)")
of_test_points_with_clear_lines_of_sight_5 = Panel(expression_34)  # "% OF TEST POINTS WITH CLEAR LINES OF SIGHT TOILET 2"
replace_nulls_3 = ReplaceNulls(Items=expression_34, Replacements="0")  # -> flatten(Items), Count

living_toilet_2 = DataRecorder(replace_nulls_3.Items, DataLimit=-10, RecordData=False)
livedata_do_not_internalize_4 = Data(living_toilet_2)

doors_boundaries_5 = Curve(pline_9)
curve_curve_12 = CurveCurve(CurveA=explode_tree_13.Branch2, CurveB=doors_boundaries_5)  # -> Points, ParamsA, ParamsB
circle_5 = Circle(Plane=curve_curve_12.Points, Radius=door_visibility_radius_2)
curve_curve_13 = CurveCurve(CurveA=circle_5, CurveB=doors_boundaries_5)  # -> flatten(Points), ParamsA, ParamsB
list_item_18 = ListItem(List=curve_curve_13.Points, Index=0, Wrap=True)
circle_6 = Circle(Plane=list_item_18, Radius=door_visibility_radius_2)
curve_curve_14 = CurveCurve(CurveA=circle_6, CurveB=flatten(isovistlines_2))  # -> Points, ParamsA, ParamsB
remove_duplicate_points_karamba3d_3 = RemoveDuplicatePointsKaramba3D(Point=curve_curve_14.Points, LimitDistance=0.005)  # -> simplify(OutPoint), Info, Indexes
clean_tree_4 = CleanTree(RemoveNulls=True, RemoveInvalid=True, RemoveEmpty=True, Tree=remove_duplicate_points_karamba3d_3.OutPoint)
panel_78 = Panel(clean_tree_4)
tree_statistics_3 = TreeStatistics(Tree=clean_tree_4)  # -> Paths, Length, Count
list_length_24 = ListLength(List=tree_statistics_3.Paths)
total_number_of_test_points_5 = Panel(totalnumberoftestpoints)
expression_35 = Expression(x=list_length_24, y=total_number_of_test_points_5, Expression="(x / y)")
of_test_points_with_clear_lines_of_sight_6 = Panel(expression_35)  # "% OF TEST POINTS WITH CLEAR LINES OF SIGHT TOILET 2"
replace_nulls_4 = ReplaceNulls(Items=expression_35, Replacements="0")  # -> flatten(Items), Count

living_toilet_3 = DataRecorder(replace_nulls_4.Items, DataLimit=-10, RecordData=False)
livedata_do_not_internalize_5 = Data(living_toilet_3)

replace_nulls_5 = ReplaceNulls(Items=expression_33, Replacements="0")  # -> flatten(Items), Count

living_toilet_1 = DataRecorder(replace_nulls_5.Items, DataLimit=-10, RecordData=False)
livedata_do_not_internalize_6 = Data(living_toilet_1)

toilet_1_data_recorder_2 = Data(livedata_do_not_internalize_6)
living_toilet_1_2 = Panel(toilet_1_data_recorder_2)
reverse_list_17 = ReverseList(List=toilet_1_data_recorder_2)
living_toilet_1_3 = Panel(reverse_list_17)

toilet_3_data_recorder_2 = Data(livedata_do_not_internalize_5)
living_toilet_3_2 = Panel(toilet_3_data_recorder_2)
reverse_list_18 = ReverseList(List=toilet_3_data_recorder_2)
living_toilet_3_3 = Panel(reverse_list_18)

toilet_2_data_recorder_2 = Data(livedata_do_not_internalize_4)
living_toilet_2_2 = Panel(toilet_2_data_recorder_2)
reverse_list_19 = ReverseList(List=toilet_2_data_recorder_2)
living_toilet_2_3 = Panel(reverse_list_19)

reverse_list_20 = ReverseList(List=livedata_do_not_internalize_6)
reverse_list_21 = ReverseList(List=livedata_do_not_internalize_4)
reverse_list_22 = ReverseList(List=livedata_do_not_internalize_5)

internalize_21 = Data(reverse_list_20)
internalize_22 = Data(reverse_list_21)
internalize_23 = Data(reverse_list_22)
toilet_1_data_recorder_3 = Data(internalize_21)
toilet_2_data_recorder_3 = Data(internalize_22)
toilet_3_data_recorder_3 = Data(internalize_23)

internalize_24 = Data(reverse_list_21)
internalize_25 = Data(reverse_list_22)
internalize_26 = Data(reverse_list_20)
toilet_1_data_recorder_4 = Data(internalize_26)
toilet_2_data_recorder_4 = Data(internalize_24)
toilet_3_data_recorder_4 = Data(internalize_25)

doors_boundaries_6 = Curve(pline_9)
curve_curve_15 = CurveCurve(CurveA=explode_tree.Branch0, CurveB=doors_boundaries_6)  # -> Points, ParamsA, ParamsB
circle_7 = Circle(Plane=curve_curve_15.Points, Radius=door_visibility_radius)
curve_curve_16 = CurveCurve(CurveA=circle_7, CurveB=doors_boundaries_6)  # -> Points, ParamsA, ParamsB
total_number_of_test_points_6 = Panel(totalnumberoftestpoints)

list_item_19 = ListItem(List=curve_curve_16.Points, Index=0, Wrap=True)

doors_boundaries_7 = Curve(pline_9)
curve_curve_17 = CurveCurve(CurveA=explode_tree.Branch3, CurveB=doors_boundaries_7)  # -> Points, ParamsA, ParamsB
circle_8 = Circle(Plane=curve_curve_17.Points, Radius=door_visibility_radius)
curve_curve_18 = CurveCurve(CurveA=circle_8, CurveB=doors_boundaries_7)  # -> flatten(Points), ParamsA, ParamsB
circle_9 = Circle(Plane=curve_curve_18.Points, Radius=door_visibility_radius)
total_number_of_test_points_7 = Panel(totalnumberoftestpoints)

list_item_20 = ListItem(List=circle_9, Index=0, Wrap=True)  # -> Item1, Item

curve_curve_19 = CurveCurve(CurveA=list_item_20.Item, CurveB=flatten(isovistlines_2))  # -> Points, ParamsA, ParamsB
remove_duplicate_points_karamba3d_4 = RemoveDuplicatePointsKaramba3D(Point=curve_curve_19.Points, LimitDistance=0.005)  # -> simplify(OutPoint), Info, Indexes
clean_tree_5 = CleanTree(RemoveNulls=True, RemoveInvalid=True, RemoveEmpty=True, Tree=remove_duplicate_points_karamba3d_4.OutPoint)
tree_statistics_4 = TreeStatistics(Tree=clean_tree_5)  # -> Paths, Length, Count
list_length_25 = ListLength(List=tree_statistics_4.Paths)
expression_36 = Expression(x=list_length_25, y=total_number_of_test_points_7, Expression="(x / y)")
of_test_points_with_clear_lines_of_sight_7 = Panel(expression_36)  # "% OF TEST POINTS WITH CLEAR LINES OF SIGHT TOILET 1"
replace_nulls_6 = ReplaceNulls(Items=expression_36, Replacements="0")  # -> flatten(Items), Count

living_bedroom_4 = DataRecorder(replace_nulls_6.Items, DataLimit=-10, RecordData=False)
livedata_do_not_internalize_7 = Data(living_bedroom_4)

bedroom_4_data_recorder_2 = Data(livedata_do_not_internalize_7)
bedroom_4 = Panel(bedroom_4_data_recorder_2)
reverse_list_23 = ReverseList(List=bedroom_4_data_recorder_2)
bedroom_4_2 = Panel(reverse_list_23)

reverse_list_24 = ReverseList(List=livedata_do_not_internalize_7)

internalize_27 = Data(reverse_list_24)
bedroom_4_data_recorder_3 = Data(internalize_27)

internalize_28 = Data(reverse_list_24)
bedroom_4_data_recorder_4 = Data(internalize_28)

doors_boundaries_8 = Curve(pline_9)
curve_curve_20 = CurveCurve(CurveA=explode_tree.Branch1, CurveB=doors_boundaries_8)  # -> Points, ParamsA, ParamsB
circle_10 = Circle(Plane=curve_curve_20.Points, Radius=door_visibility_radius)
curve_curve_21 = CurveCurve(CurveA=circle_10, CurveB=doors_boundaries_8)  # -> flatten(Points), ParamsA, ParamsB
circle_11 = Circle(Plane=curve_curve_21.Points, Radius=door_visibility_radius)
total_number_of_test_points_8 = Panel(totalnumberoftestpoints)

list_item_21 = ListItem(List=circle_11, Index=0, Wrap=True)  # -> Item1, Item

curve_curve_22 = CurveCurve(CurveA=list_item_21.Item, CurveB=flatten(isovistlines_2))  # -> Points, ParamsA, ParamsB
remove_duplicate_points_karamba3d_5 = RemoveDuplicatePointsKaramba3D(Point=curve_curve_22.Points, LimitDistance=0.005)  # -> simplify(OutPoint), Info, Indexes
clean_tree_6 = CleanTree(RemoveNulls=True, RemoveInvalid=True, RemoveEmpty=True, Tree=remove_duplicate_points_karamba3d_5.OutPoint)
tree_statistics_5 = TreeStatistics(Tree=clean_tree_6)  # -> Paths, Length, Count
list_length_26 = ListLength(List=tree_statistics_5.Paths)
expression_37 = Expression(x=list_length_26, y=total_number_of_test_points_8, Expression="(x / y)")
of_test_points_with_clear_lines_of_sight_8 = Panel(expression_37)  # "% OF TEST POINTS WITH CLEAR LINES OF SIGHT TOILET 1"
replace_nulls_7 = ReplaceNulls(Items=expression_37, Replacements="0")  # -> flatten(Items), Count

living_bedroom_2 = DataRecorder(replace_nulls_7.Items, DataLimit=-10, RecordData=False)
livedata_do_not_internalize_8 = Data(living_bedroom_2)

bedroom_2_data_recorder_2 = Data(livedata_do_not_internalize_8)
bedroom_2 = Panel(bedroom_2_data_recorder_2)
reverse_list_25 = ReverseList(List=bedroom_2_data_recorder_2)
bedroom_2_2 = Panel(reverse_list_25)

reverse_list_26 = ReverseList(List=livedata_do_not_internalize_8)

internalize_29 = Data(reverse_list_26)
bedroom_2_data_recorder_3 = Data(internalize_29)

internalize_30 = Data(reverse_list_26)
bedroom_2_data_recorder_4 = Data(internalize_30)

# ----
# Write DataTree to Excel
doors_boundaries_9 = Curve(pline_9)
curve_curve_23 = CurveCurve(CurveA=explode_tree.Branch5, CurveB=doors_boundaries_9)  # -> Points, ParamsA, ParamsB
circle_12 = Circle(Plane=curve_curve_23.Points, Radius=door_visibility_radius)
curve_curve_24 = CurveCurve(CurveA=circle_12, CurveB=doors_boundaries_9)  # -> flatten(Points), ParamsA, ParamsB
circle_13 = Circle(Plane=curve_curve_24.Points, Radius=door_visibility_radius)
total_number_of_test_points_9 = Panel(totalnumberoftestpoints)

list_item_22 = ListItem(List=circle_13, Index=0, Wrap=True)  # -> Item1, Item

curve_curve_25 = CurveCurve(CurveA=[list_item_22.Item1, list_item_22.Item], CurveB=flatten(isovistlines_2))  # -> Points, ParamsA, ParamsB
remove_duplicate_points_karamba3d_6 = RemoveDuplicatePointsKaramba3D(Point=curve_curve_25.Points, LimitDistance=0.005)  # -> simplify(OutPoint), Info, Indexes
clean_tree_7 = CleanTree(RemoveNulls=True, RemoveInvalid=True, RemoveEmpty=True, Tree=remove_duplicate_points_karamba3d_6.OutPoint)
tree_statistics_6 = TreeStatistics(Tree=clean_tree_7)  # -> Paths, Length, Count
list_length_27 = ListLength(List=tree_statistics_6.Paths)
expression_38 = Expression(x=list_length_27, y=total_number_of_test_points_9, Expression="(x / y)")
of_test_points_with_clear_lines_of_sight_9 = Panel(expression_38)  # "% OF TEST POINTS WITH CLEAR LINES OF SIGHT TOILET 1"
replace_nulls_8 = ReplaceNulls(Items=expression_38, Replacements="0")  # -> flatten(Items), Count

living_bedroom_6 = DataRecorder(replace_nulls_8.Items, DataLimit=-10, RecordData=False)
livedata_do_not_internalize_9 = Data(living_bedroom_6)

bedroom_6_data_recorder_2 = Data(livedata_do_not_internalize_9)
bedroom_6 = Panel(bedroom_6_data_recorder_2)
# DISTANCE-BASED FEATURES
# WALL-TO-OPENING RATIO
# AREA RATIOS
# NEAREST DISTANCE
reverse_list_27 = ReverseList(List=bedroom_6_data_recorder_2)
bedroom_6_2 = Panel(reverse_list_27)

reverse_list_28 = ReverseList(List=livedata_do_not_internalize_9)

internalize_31 = Data(reverse_list_28)
bedroom_6_data_recorder_3 = Data(livedata_do_not_internalize_9)

internalize_32 = Data(reverse_list_28)
bedroom_6_data_recorder_4 = Data(livedata_do_not_internalize_9)

doors_boundaries_10 = Curve(pline_9)
curve_curve_26 = CurveCurve(CurveA=explode_tree.Branch2, CurveB=doors_boundaries_10)  # -> Points, ParamsA, ParamsB
circle_14 = Circle(Plane=curve_curve_26.Points, Radius=door_visibility_radius)
curve_curve_27 = CurveCurve(CurveA=circle_14, CurveB=doors_boundaries_10)  # -> flatten(Points), ParamsA, ParamsB
circle_15 = Circle(Plane=curve_curve_27.Points, Radius=door_visibility_radius)
total_number_of_test_points_10 = Panel(totalnumberoftestpoints)

list_item_23 = ListItem(List=circle_15, Index=0, Wrap=True)  # -> Item1, Item

curve_curve_28 = CurveCurve(CurveA=list_item_23.Item, CurveB=flatten(isovistlines_2))  # -> Points, ParamsA, ParamsB
remove_duplicate_points_karamba3d_7 = RemoveDuplicatePointsKaramba3D(Point=curve_curve_28.Points, LimitDistance=0.005)  # -> simplify(OutPoint), Info, Indexes
clean_tree_8 = CleanTree(RemoveNulls=True, RemoveInvalid=True, RemoveEmpty=True, Tree=remove_duplicate_points_karamba3d_7.OutPoint)
tree_statistics_7 = TreeStatistics(Tree=clean_tree_8)  # -> Paths, Length, Count
list_length_28 = ListLength(List=tree_statistics_7.Paths)
expression_39 = Expression(x=list_length_28, y=total_number_of_test_points_10, Expression="(x / y)")
of_test_points_with_clear_lines_of_sight_10 = Panel(expression_39)  # "% OF TEST POINTS WITH CLEAR LINES OF SIGHT TOILET 1"
replace_nulls_9 = ReplaceNulls(Items=expression_39, Replacements="0")  # -> flatten(Items), Count

living_bedroom_3 = DataRecorder(replace_nulls_9.Items, DataLimit=-10, RecordData=False)
livedata_do_not_internalize_10 = Data(living_bedroom_3)

bedroom_3_data_recorder_2 = Data(livedata_do_not_internalize_10)
bedroom_3 = Panel(bedroom_3_data_recorder_2)
reverse_list_29 = ReverseList(List=bedroom_3_data_recorder_2)
bedroom_3_2 = Panel(reverse_list_29)

reverse_list_30 = ReverseList(List=livedata_do_not_internalize_10)

internalize_33 = Data(reverse_list_30)
bedroom_3_data_recorder_3 = Data(internalize_33)

internalize_34 = Data(reverse_list_30)
bedroom_3_data_recorder_4 = Data(internalize_34)

doors_boundaries_11 = Curve(pline_9)
curve_curve_29 = CurveCurve(CurveA=explode_tree.Branch4, CurveB=doors_boundaries_11)  # -> Points, ParamsA, ParamsB
circle_16 = Circle(Plane=curve_curve_29.Points, Radius=door_visibility_radius)
curve_curve_30 = CurveCurve(CurveA=circle_16, CurveB=doors_boundaries_11)  # -> flatten(Points), ParamsA, ParamsB
circle_17 = Circle(Plane=curve_curve_30.Points, Radius=door_visibility_radius)
total_number_of_test_points_11 = Panel(totalnumberoftestpoints)

list_item_24 = ListItem(List=circle_17, Index=0, Wrap=True)  # -> Item1, Item

curve_curve_31 = CurveCurve(CurveA=list_item_24.Item, CurveB=flatten(isovistlines_2))  # -> Points, ParamsA, ParamsB
remove_duplicate_points_karamba3d_8 = RemoveDuplicatePointsKaramba3D(Point=curve_curve_31.Points, LimitDistance=0.005)  # -> simplify(OutPoint), Info, Indexes
clean_tree_9 = CleanTree(RemoveNulls=True, RemoveInvalid=True, RemoveEmpty=True, Tree=remove_duplicate_points_karamba3d_8.OutPoint)
tree_statistics_8 = TreeStatistics(Tree=clean_tree_9)  # -> Paths, Length, Count
list_length_29 = ListLength(List=tree_statistics_8.Paths)
expression_40 = Expression(x=list_length_29, y=total_number_of_test_points_11, Expression="(x / y)")
of_test_points_with_clear_lines_of_sight_11 = Panel(expression_40)  # "% OF TEST POINTS WITH CLEAR LINES OF SIGHT TOILET 1"
replace_nulls_10 = ReplaceNulls(Items=expression_40, Replacements="0")  # -> flatten(Items), Count

living_bedroom_5 = DataRecorder(replace_nulls_10.Items, DataLimit=-10, RecordData=False)
livedata_do_not_internalize_11 = Data(living_bedroom_5)

bedroom_5_data_recorder_2 = Data(livedata_do_not_internalize_11)
bedroom_5 = Panel(bedroom_5_data_recorder_2)
reverse_list_31 = ReverseList(List=bedroom_5_data_recorder_2)
bedroom_5_2 = Panel(reverse_list_31)

reverse_list_32 = ReverseList(List=livedata_do_not_internalize_11)

internalize_35 = Data(reverse_list_32)
bedroom_5_data_recorder_3 = Data(internalize_35)

internalize_36 = Data(reverse_list_32)
bedroom_5_data_recorder_4 = Data(internalize_36)

circle_18 = Circle(Plane=list_item_19, Radius=door_visibility_radius)

list_item_25 = ListItem(List=circle_18, Index=0, Wrap=True)  # -> Item1, Item

curve_curve_32 = CurveCurve(CurveA=list_item_25.Item, CurveB=flatten(isovistlines_2))  # -> Points, ParamsA, ParamsB
remove_duplicate_points_karamba3d_9 = RemoveDuplicatePointsKaramba3D(Point=curve_curve_32.Points, LimitDistance=0.005)  # -> simplify(OutPoint), Info, Indexes
clean_tree_10 = CleanTree(RemoveNulls=True, RemoveInvalid=True, RemoveEmpty=True, Tree=remove_duplicate_points_karamba3d_9.OutPoint)
tree_statistics_9 = TreeStatistics(Tree=clean_tree_10)  # -> Paths, Length, Count
list_length_30 = ListLength(List=tree_statistics_9.Paths)
expression_41 = Expression(x=list_length_30, y=total_number_of_test_points_6, Expression="(x / y)")
of_test_points_with_clear_lines_of_sight_12 = Panel(expression_41)  # "% OF TEST POINTS WITH CLEAR LINES OF SIGHT TOILET 1"
replace_nulls_11 = ReplaceNulls(Items=expression_41, Replacements="0")  # -> flatten(Items), Count

living_bedroom_1 = DataRecorder(replace_nulls_11.Items, DataLimit=-10, RecordData=False)
livedata_do_not_internalize_12 = Data(living_bedroom_1)

bedroom_1_data_recorder_2 = Data(livedata_do_not_internalize_12)
bedroom_1 = Panel(bedroom_1_data_recorder_2)
reverse_list_33 = ReverseList(List=bedroom_1_data_recorder_2)
bedroom_1_2 = Panel(reverse_list_33)

reverse_list_34 = ReverseList(List=livedata_do_not_internalize_12)

internalize_37 = Data(reverse_list_34)
bedroom_1_data_recorder_3 = Data(internalize_37)

internalize_38 = Data(reverse_list_34)
bedroom_1_data_recorder_4 = Data(internalize_38)

intersectionpoints = Data([curve_curve_5.Points, curve_curve_8.Points, curve_curve_11.Points, curve_curve_14.Points, curve_curve_32.Points, curve_curve_22.Points, curve_curve_28.Points, curve_curve_19.Points, curve_curve_31.Points, curve_curve_25.Points, curve_curve_4.Points])

list_item_26 = ListItem(List=intersectionpoints, Index=0, Wrap=True)
clean_tree_11 = CleanTree(RemoveNulls=True, RemoveInvalid=True, RemoveEmpty=True, Tree=list_item_26)  # -> flatten(Tree)
polygon_3 = Polygon(Plane=clean_tree_11, Radius=Slider(0.3, range=0..1), Segments=6, FilletRadius=0)  # -> Polygon, Length
boundary_surfaces_14 = BoundarySurfaces(Edges=polygon_3.Polygon)

custom_preview_5 = CustomPreview(Geometry=[isovistlines_3, boundary_surfaces_14], Material=ColourSwatch(SwatchColor=RGB(62, 194, 33)))

tree_statistics_10 = TreeStatistics(Tree=bath_boundary_3)  # -> Paths, Length, Count

of_bathrooms = DataRecorder(tree_statistics_10.Count, DataLimit=-10, RecordData=False)
livedata_do_not_internalize_13 = Data(of_bathrooms)

of_bathrooms_data_recorder_2 = Data(livedata_do_not_internalize_13)
of_bathrooms_2 = Panel(of_bathrooms_data_recorder_2)
reverse_list_35 = ReverseList(List=of_bathrooms_data_recorder_2)
# LIVING --> KITCHEN
of_bathrooms_3 = Panel(reverse_list_35)

reverse_list_36 = ReverseList(List=livedata_do_not_internalize_13)

internalize_39 = Data(reverse_list_36)
of_bathrooms_data_recorder_3 = Data(internalize_39)

internalize_40 = Data(reverse_list_36)
of_bathrooms_data_recorder_4 = Data(internalize_40)

tree_statistics_11 = TreeStatistics(Tree=bedrooms_boundary_3)  # -> Paths, Length, Count

of_bedrooms = DataRecorder(tree_statistics_11.Count, DataLimit=-10, RecordData=False)
livedata_do_not_internalize_14 = Data(of_bedrooms)

reverse_list_37 = ReverseList(List=livedata_do_not_internalize_14)

internalize_41 = Data(reverse_list_37)
of_bedrooms_data_recorder_2 = Data(internalize_41)

# ----
# Copy Data: Insert data here to copy/export the resluts to excel.
# 
# 'copy data only'
internalize_42 = Data(reverse_list_37)
of_bedrooms_data_recorder_3 = Data(internalize_42)

of_bedrooms_data_recorder_4 = Data(livedata_do_not_internalize_14)
of_bedrooms_2 = Panel(of_bedrooms_data_recorder_4)
reverse_list_38 = ReverseList(List=of_bedrooms_data_recorder_4)
of_bedrooms_3 = Panel(reverse_list_38)

# ==== cluster ArrangeLayer
F = ClusterInput()
G = ClusterInput()
Z = UnitZ(Factor=F)
movevisibility = Move(Geometry=G, Motion=Z)  # -> Geometry, Transform
G_2 = ClusterOutput(movevisibility.Geometry)

# ==== cluster Cluster
curve_a = ClusterInput()
curve_b = ClusterInput()
curve_curve = CurveCurve(CurveA=curve_a, CurveB=flatten(curve_b))  # -> Points, ParamsA, ParamsB
remove_duplicate_points_karamba3d = RemoveDuplicatePointsKaramba3D(Point=curve_curve.Points, LimitDistance=0.005)  # -> simplify(OutPoint), Info, Indexes
clean_tree = CleanTree(RemoveNulls=True, RemoveInvalid=True, RemoveEmpty=True, Tree=remove_duplicate_points_karamba3d.OutPoint)
trim_tree = TrimTree(Tree=clean_tree, Depth=1)
tree_statistics = TreeStatistics(Tree=trim_tree)  # -> Paths, Length, Count
list_length = ListLength(List=tree_statistics.Paths)
length = ClusterOutput(list_length)
